# Dynamo graph BIM1_DeleteImportLinePatterns.dyn (Dynamo 2.0.2.6826)

# note: BACKEND
# note: MONITORING
# note: USER INTERFACE
# note: INPUT

# group: BIMOne
# note: DEPENDANCIES
# CODE
# note: EDITOR
# Jean-Marc Couffin - May 2019 - v1.1
# note: CREATOR
# Jean-Marc Couffin - July 2018 - v1.0
# Dynamo 2.0
# note: Copyright:
# This script is provided "as-is" under MIT License
# note: Created by BIMOne
# Delete IMPORTED Line patterns from imported DWG

# group: PACKAGE NAME
# note: Always name the specific package to facilitate debugging and deployment
# Exploding a package helps deployment to clients
# Example:
# Clockworks 1.5.5

# group: ACTION - DATA
# note: part of the script that affect data:
# Examples:
# ACTION - DATA - get parameter name from txt file

# group: MONITORING - description
# note: ckeck the integrity and consistency of data or geometry affected
# Examples:
# number of rooms matches number of parameters changed

# group: ACTION - GEOMETRY
# note: part of the script that affect  geometry:
# Examples:
# ACTION - GEOMETRY - translate geometry to new location

# group: UI
# note: User interface for the script: describe what the UI will do
# Example:
# UI - get shared parameter file path

# group: CONSTRAINT
# note: Fixed input that should not be set as inputs available through the dynamo player

# group: INPUT
# note: input by user that should be set as input for the dynamo player

# group: ACTION - DATA Check revit language
looks_up_for_some_french_to = Python()  # "Looks up for some french to design the interface"; unwired: IN[0]
# ---------- looks_up_for_some_french_to.python (16 lines) ----------
# BIM One Inc. - Jean-Marc Couffin - 2018

import clr
clr.AddReference('RevitServices')
from RevitServices.Persistence import DocumentManager

doc = DocumentManager.Instance.CurrentDBDocument

lang = str(doc.Application.Language)

if lang =="French":
	x = True
else:
	x = False
	
OUT = x
# ----------------------------------------

# group: Français
string = StringInput("BIM OneInc. -  Motifs de lignes importés effacés")
string_2 = StringInput("Motifs de lignes IMPORT effacés")
list_create = List.Create(item0=string, item1=string_2)

# group: English
string_3 = StringInput("BIM One Inc. - Imported Line patterns deleted")
string_4 = StringInput("IMPORT Line patterns deleted")
list_create_2 = List.Create(item0=string_3, item1=string_4)

if_ = If(test=looks_up_for_some_french_to, true=list_create, false=list_create_2)
code_block = CodeBlock(x=if_) { x[0]; x[1]; }

# group: INPUT Name of lines contains the following string
code_block_2 = CodeBlock()
# ---------- code_block_2.designscript (3 lines) ----------
"IMPORT";
false;
//-------------------------------//;
# ----------------------------------------

# group: ACTION - DATA Collect all line patterns
collect_line_pattern_names_and = Python(IN[0]=code_block_2.out0)  # "Collect line pattern names and elements"
# ---------- collect_line_pattern_names_and.python (56 lines) ----------
# This node has been made by Modelical
# www.modelical.com

import clr
clr.AddReference('ProtoGeometry')
from Autodesk.DesignScript.Geometry import *

#Load Dynamo wrappers
clr.AddReference("RevitNodes")
import Revit
from Revit.Elements import *
clr.ImportExtensions(Revit.GeometryConversion)
clr.ImportExtensions(Revit.Elements)

#Load Revit API
clr.AddReference('RevitAPI')
from Autodesk.Revit.DB import *
import Autodesk

#Load document reference
clr.AddReference("RevitServices")
import RevitServices
from RevitServices.Persistence import DocumentManager
from RevitServices.Transactions import TransactionManager

doc = DocumentManager.Instance.CurrentDBDocument
uiapp = DocumentManager.Instance.CurrentUIApplication
app = uiapp.Application

def toList(input):
	if isinstance(input,list) == False:
		return [input]
	else:
		return input

def flatten(x):
    result = []
    for el in x:
        if hasattr(el, "__iter__") and not isinstance(el, basestring):
            result.extend(flatten(el))
        else:
            result.append(el)
    return result

txt = IN[0]


collector = FilteredElementCollector(doc)
allLinePatterns = collector.OfClass(LinePatternElement).ToElements()

a = []

a.append(i.Name for i in allLinePatterns)
	

OUT = allLinePatterns, flatten(a)
# ----------------------------------------
code_block_3 = CodeBlock(x=collect_line_pattern_names_and) { x[0]; x[1]; }
contains = String.Contains(str=code_block_3.out1, searchFor=code_block_2.out0, ignoreCase=code_block_2.out1)
filterByBoolMask = List.FilterByBoolMask(list=code_block_3.out0, mask=contains)
filterByBoolMask_2 = List.FilterByBoolMask(list=code_block_3.out1, mask=contains)

# group: ACTION - DATA Delete line patterns that contains the word IMPORT
code_block_4 = CodeBlock { true; }
python_script = Python(IN[0]=filterByBoolMask.in, IN[1]=code_block_4)
# ---------- python_script.python (35 lines) ----------
#Copyright(c) 2016, Dimitar Venkov
# @5devene, dimitar.ven@gmail.com

import clr

clr.AddReference("RevitServices")
import RevitServices
from RevitServices.Persistence import DocumentManager
from RevitServices.Transactions import TransactionManager
doc = DocumentManager.Instance.CurrentDBDocument

def tolist(obj1):
	if hasattr(obj1,"__iter__"): return obj1
	else: return [obj1]

elems = UnwrapElement(tolist(IN[0]) )

if IN[1]:
	deleted, failed = [], []
	TransactionManager.Instance.EnsureInTransaction(doc)
	for e in elems:
		id = None
		try:
			id = e.Id
			del_id = doc.Delete(id)
			deleted.extend([d.ToString() for d in del_id])
		except:
			if id is not None:
				failed.append(id.ToString() )
	TransactionManager.Instance.TransactionTaskDone()
	s = set(deleted)
	failed1 = [x for x in failed if x not in s]
	OUT = len(deleted)
else:
	OUT = "Set confirm to True", "", ""
# ----------------------------------------

transform_list_of_names_into = Python(IN[0]=filterByBoolMask_2.in)  # "Transform list of names into strings paragraph"
# ---------- transform_list_of_names_into.python (1 lines) ----------
OUT = str('\n'.join(IN[0]))
# ----------------------------------------

# group: MONITORING Count how many were processed
python_script_2 = Python(IN[0]=code_block.out0, IN[1]=python_script, IN[2]=code_block.out1, IN[3]=transform_list_of_names_into)
# ---------- python_script_2.python (13 lines) ----------
# BIM One Inc. - Jean-Marc Couffin - 2019

import clr
clr.AddReference('RevitAPIUI')
from Autodesk.Revit.UI import TaskDialog


Title = IN[0]
TotalCount = str(IN[1])
Processed = IN[2]
Deleted = IN[3]

TaskDialog.Show( Title, TotalCount + ' ' + Processed + "\n" + "\n" + str(Deleted))
# ----------------------------------------
