# Dynamo graph BIM1_FlipWorkplane.dyn (Dynamo 2.3.0.5885)

# note: BACKEND
# note: MONITORING
# note: USER INTERFACE

# group: BIMOne
# note: EDITOR
# note: DEPENDANCIES
# CODE
# note: CREATOR
# Jean-Marc Couffin - Mars 2020 - v1.0
# Dynamo 2.0
# note: Copyright:
# This script is provided "as-is" under MIT License
# note: Created by BIMOne
# Flip element workplane in section

# group: PACKAGE NAME
# note: Always name the specific package to facilitate debugging and deployment
# Exploding a package helps deployment to clients
# Example:
# Clockworks 1.5.5

# group: MONITORING - description
# note: ckeck the integrity and consistency of data or geometry affected
# Examples:
# number of rooms matches number of parameters changed

# group: ACTION - DATA
# note: part of the script that affect data:
# Examples:
# ACTION - DATA - get parameter name from txt file

# group: ACTION - GEOMETRY
# note: part of the script that affect  geometry:
# Examples:
# ACTION - GEOMETRY - translate geometry to new location

# group: UI
# note: User interface for the script: describe what the UI will do
# Example:
# UI - get shared parameter file path

# group: CONSTRAINT
# note: Fixed input that should not be set as inputs available through the dynamo player

# group: INPUT
# note: input by user that should be set as input for the dynamo player

# group: INPUT Force refresh
# note: INPUT
boolean = BoolSelector(true)

# group: ACTION - GEOMETRY Get Revit Selection
python_script = Python(IN[0]=boolean)
# ---------- python_script.python (20 lines) ----------
#Get current selection
import clr
clr.AddReference("RevitNodes")
import Revit
clr.ImportExtensions(Revit.Elements)
clr.AddReference("RevitServices")
import RevitServices
from RevitServices.Persistence import DocumentManager

doc = DocumentManager.Instance.CurrentDBDocument
uidoc=DocumentManager.Instance.CurrentUIApplication.ActiveUIDocument

select = []
elements = []
select = uidoc.Selection.GetElementIds()

for i in select:
		elements.append(doc.GetElement(i).ToDSType(True))

OUT = elements
# ----------------------------------------

# group: ACTION - GEOMETRY Flip items
python_script_2 = Python(IN[0]=python_script)
# ---------- python_script_2.python (33 lines) ----------
#Portions of code by Daniel_Woodcock1 on foum.dynamobim.com
import clr

clr.AddReference("RevitServices")
import RevitServices
from RevitServices.Persistence import DocumentManager
from RevitServices.Transactions import TransactionManager
doc =  DocumentManager.Instance.CurrentDBDocument

clr.AddReference("RevitNodes")
import Revit
clr.ImportExtensions(Revit.Elements)
clr.ImportExtensions(Revit.GeometryConversion)

clr.AddReference("RevitAPI")
from Autodesk.Revit.DB import *

def tolist(obj1):
	if hasattr(obj1,"__iter__"): return obj1
	else: return [obj1]

elems = tolist(UnwrapElement(IN[0]))
results = []
TransactionManager.Instance.EnsureInTransaction(doc)
for elem in elems:
#Set opposite condition of plan flip for element
	if elem.IsWorkPlaneFlipped == True:
		elem.IsWorkPlaneFlipped = False
	else:
		elem.IsWorkPlaneFlipped = True
	results.append(elem.IsWorkPlaneFlipped)
TransactionManager.Instance.TransactionTaskDone()
OUT = results
# ----------------------------------------
