# Dynamo graph BIM1_Level_Reference.dyn "CQ_Level_Reference_2.0" (Dynamo 2.3.0.5885)

# note: MONITORING
# note: BACKEND

# group: PACKAGE NAME
# note: Always name the specific package to facilitate debugging and deployment
# Exploding a package helps deployment to clients
# Example:
# Clockworks 1.5.5

# group: MONITORING - description
# note: ckeck the integrity and consistency of data or geometry affected
# Examples:
# number of rooms matches number of parameters changed

# group: ACTION - DATA
# note: part of the script that affect data:
# Examples:
# ACTION - DATA - get parameter name from txt file

# group: ACTION - GEOMETRY
# note: part of the script that affect  geometry:
# Examples:
# ACTION - GEOMETRY - translate geometry to new location

# group: UI
# note: User interface for the script: describe what the UI will do
# Example:
# UI - get shared parameter file path

# group: BIMOne
# note: DEPENDANCIES
# CODE
# note: EDITOR
# Jean-Marc Couffin - Mars 2020 - v1.1
# Jean-Marc Couffin - Avril 2020 - v1.2
# note: CREATOR
# Bruno-Pierre Caron - 2019 - v1.0
# Dynamo 2.0
# note: Copyright:
# This script is provided "as-is" under MIT License
# note: Created by BIMOne
# Assign proper level to MEP equipment

# group: CONSTRAINT
# note: Fixed input that should not be set as inputs available through the dynamo player

# group: INPUT
# note: input by user that should be set as input for the dynamo player

# group: Categories that contains Offset and Level parameters
code_block = CodeBlock()
# ---------- code_block.designscript (1 lines) ----------
["OST_PipeCurves", "OST_CableTray", "OST_Conduit", "OST_DuctCurves","OST_CableTrayFitting", "OST_ConduitFitting", "OST_CommunicationDevices", "OST_DataDevices", "OST_ElectricalEquipment", "OST_ElectricalFixtures", "OST_FireAlarmDevices","OST_LightingDevices", "OST_SecurityDevices", "OST_NurseCallDevices","OST_LightingFixtures", "OST_DuctTerminal", "OST_DuctAccessory", "OST_DuctFitting", "OST_MechanicalEquipment", "OST_PipeAccessory", "OST_PipeFitting", "OST_PlumbingFixtures", "OST_Sprinklers"];
# ----------------------------------------
python_script = Python(IN[0]=code_block)
# ---------- python_script.python (38 lines) ----------
import System
import clr
clr.AddReference('RevitAPI')
from Autodesk.Revit.DB import *

clr.AddReference("RevitNodes")
import Revit
clr.ImportExtensions(Revit.Elements)

clr.AddReference("RevitServices")
import RevitServices
from RevitServices.Persistence import DocumentManager

def GetBicFromInput(var):	
	bic = None
	if var:
		cattype = var.GetType().ToString()
		if cattype == "Revit.Elements.Category": bic = System.Enum.ToObject(BuiltInCategory, var.Id)
		elif cattype == "Autodesk.Revit.DB.BuiltInCategory": bic = var
		elif cattype == "System.String": 
			found = [x for x in bics if x.ToString() == var]
			if len(found) > 0: bic = found[0]
	return bic

def ElementsByCategory(bic, doc):
	collector = FilteredElementCollector(doc).OfCategory(bic).WhereElementIsNotElementType()
	return collector.ToElements()

doc = DocumentManager.Instance.CurrentDBDocument
bics = System.Enum.GetValues(BuiltInCategory)

catz = IN[0]
bicfromcatz = []

for i in  catz:
	bicfromcatz.append(ElementsByCategory(GetBicFromInput(i),doc))

OUT = bicfromcatz
# ----------------------------------------

flatten = List.Flatten(list=python_script)

# group: ACTION - DATA BUILTIN PARAMETERS
# note: INPUT
code_block_2 = CodeBlock { ["RBS_OFFSET_PARAM","FAMILY_LEVEL_PARAM","RBS_START_LEVEL_PARAM","DATUM_TEXT","LEVEL_ELEV","INSTANCE_FREE_HOST_OFFSET_PARAM"]; }
# note: USER INTERFACE
code_block_3 = CodeBlock(x=code_block_2) { x[0]; x[1]; x[2]; x[3]; x[4]; x[5]; }

get_builtin_parameter_values = Python(IN[0]=code_block_3.out0, IN[1]=flatten)
# ---------- get_builtin_parameter_values.python (109 lines) ----------
#Copyright(c) 2015, Konrad K Sobon
# @arch_laboratory, http://archi-lab.net

import clr
import sys
clr.AddReference('ProtoGeometry')
from Autodesk.DesignScript.Geometry import *

pyt_path = r'C:\Program Files (x86)\IronPython 2.7\Lib'
sys.path.append(pyt_path)

# Import Element wrapper extension methods
clr.AddReference("RevitNodes")
import Revit
clr.ImportExtensions(Revit.Elements)

# Import DocumentManager and TransactionManager
clr.AddReference("RevitServices")
import RevitServices
from RevitServices.Persistence import DocumentManager
from RevitServices.Transactions import TransactionManager

doc = DocumentManager.Instance.CurrentDBDocument
uiapp = DocumentManager.Instance.CurrentUIApplication
app = uiapp.Application

# Import RevitAPI
clr.AddReference("RevitAPI")
import Autodesk
from Autodesk.Revit.DB import *
import System

#The inputs to this node will be stored as a list in the IN variable.
dataEnteringNode = IN

paramNames = IN[0]

if isinstance(IN[1], list):
	elems = []
	for i in IN[1]:
		elems.append(UnwrapElement(i))
else:
	elems = IN[1]

elements = []
for i in elems:
	elements.append(UnwrapElement(i))

def ProcessList(_func, _list):
    return map( lambda x: ProcessList(_func, x) if type(x)==list else _func(x), _list )

def ProcessListArg(_func, _list, _arg):
    return map( lambda x: ProcessListArg(_func, x, _arg) if type(x)==list else _func(x, _arg), _list )

def GetBuiltInParam(paramName):
	builtInParams = System.Enum.GetValues(BuiltInParameter)
	test = []
	for i in builtInParams:
		if i.ToString() == paramName:
			test.append(i)
			break
		else:
			continue
	return test[0]

def GetBipValue(element, bip):
	doc = DocumentManager.Instance.CurrentDBDocument
	value = None
	try:
		tempValue = element.get_Parameter(bip)
	except:
		tempValue = None
		pass
	if tempValue != None and tempValue.HasValue:
		if element.get_Parameter(bip).StorageType == StorageType.String:
			value = element.get_Parameter(bip).AsString()
		elif element.get_Parameter(bip).StorageType == StorageType.Integer:
			value  = element.get_Parameter(bip).AsInteger()
		elif element.get_Parameter(bip).StorageType == StorageType.Double:
			value = element.get_Parameter(bip).AsDouble()
		elif element.get_Parameter(bip).StorageType == StorageType.ElementId:
			id = element.get_Parameter(bip).AsElementId()
			value = doc.GetElement(id)
		return value
	else:
		return None

try:
	errorReport = None
	paramValues = []
	if isinstance(paramNames, list):
		builtInParams = ProcessList(GetBuiltInParam, paramNames)
		for i in builtInParams:
			paramValues.append(ProcessListArg(GetBipValue, elements, i))
	else:
		builtInParams = GetBuiltInParam(paramNames)
		if isinstance(elems, list):
			for i in elems:
				paramValues.append(GetBipValue(i, builtInParams))
except:
	# if error accurs anywhere in the process catch it
	import traceback
	errorReport = traceback.format_exc()

#Assign your output to the OUT variable
if errorReport == None:
	OUT = paramValues
else:
	OUT = errorReport
# ----------------------------------------
code_block_4 = CodeBlock(x=get_builtin_parameter_values) { x!=null; }
filterByBoolMask = List.FilterByBoolMask(list=flatten, mask=code_block_4)
get_builtin_parameter_values_2 = Python(IN[0]=code_block_3.out1, IN[1]=filterByBoolMask.in)  # same code as get_builtin_parameter_values
code_block_5 = CodeBlock(x=get_builtin_parameter_values_2) { x!=null; }
filterByBoolMask_2 = List.FilterByBoolMask(list=filterByBoolMask.in, mask=code_block_5)
get_builtin_parameter_values_3 = Python(IN[0]=code_block_3.out2, IN[1]=filterByBoolMask_2.out)  # same code as get_builtin_parameter_values
type = Object.Type(obj=get_builtin_parameter_values_3)
python_script_2 = Python(IN[0]=filterByBoolMask_2.out, IN[1]=type)
# ---------- python_script_2.python (17 lines) ----------
import clr
clr.AddReference('ProtoGeometry')
from Autodesk.DesignScript.Geometry import *
#The inputs to this node will be stored as a list in the IN variables.
elements = IN[0]
host = IN[1]
withlevel = []
nolevel =[]

for x in range(len(host)):
	if "Level" in host[x]:
		withlevel.append(elements[x])
	else:
		nolevel.append(elements[x])

#Assign your output to the OUT variable.
OUT = withlevel, nolevel
# ----------------------------------------
get_builtin_parameter_values_4 = Python(IN[0]=code_block_3.out1, IN[1]=filterByBoolMask.out)  # same code as get_builtin_parameter_values
code_block_6 = CodeBlock(x=get_builtin_parameter_values_4) { x!=null; }
filterByBoolMask_3 = List.FilterByBoolMask(list=filterByBoolMask.out, mask=code_block_6)
code_block_7 = CodeBlock(a=python_script_2, b=filterByBoolMask_3.in) { a[0]; b; }

# group: Categories that contains Offset and Reference Level parameters
code_block_8 = CodeBlock { ["OST_Levels"]; }
python_script_3 = Python(IN[0]=code_block_8)  # same code as python_script

flatten_2 = List.Flatten(list=python_script_3)

# group: ACTION - DATA Query all levels along with their Z lowest and highest Z values
elevation = Level.Elevation(level=flatten_2)
sortByKey = List.SortByKey(list=flatten_2, keys=elevation)
get_builtin_parameter_values_5 = Python(IN[0]=code_block_3.out3, IN[1]=sortByKey.sorted_list)  # same code as get_builtin_parameter_values
get_builtin_parameter_values_6 = Python(IN[0]=code_block_3.out4, IN[1]=sortByKey.sorted_list)  # same code as get_builtin_parameter_values
code_block_9 = CodeBlock(x=get_builtin_parameter_values_6) { x*25.4*12; }
code_block_10 = CodeBlock(x=sortByKey.sorted_list) { n = Count(x)-2; }
code_block_11 = CodeBlock(x=sortByKey.sorted_list, n=code_block_10) { x[0..n]; }
python_script_4 = Python(IN[0]=code_block_11)
# ---------- python_script_4.python (64 lines) ----------
# Copyright(c) 2016, Konrad K Sobon
# @arch_laboratory, http://archi-lab.net

import clr
# Import Element wrapper extension methods
clr.AddReference("RevitNodes")
import Revit
clr.ImportExtensions(Revit.Elements)

# Import DocumentManager and TransactionManager
clr.AddReference("RevitServices")
import RevitServices
from RevitServices.Persistence import DocumentManager
doc = DocumentManager.Instance.CurrentDBDocument

# Import RevitAPI
clr.AddReference("RevitAPI")
import Autodesk
from Autodesk.Revit.DB import *

import sys
pyt_path = r'C:\Program Files (x86)\IronPython 2.7\Lib'
sys.path.append(pyt_path)

#The inputs to this node will be stored as a list in the IN variable.
dataEnteringNode = IN

if isinstance(IN[0], list):
	levels = IN[0]
else:
	levels = [IN[0]]

def ProcessList(_func, _list):
    return map( lambda x: ProcessList(_func, x) if type(x)==list else _func(x), _list )

def GetLevelAbove(e):
	doc = DocumentManager.Instance.CurrentDBDocument
	allLevels = FilteredElementCollector(doc) \
				.OfCategory(BuiltInCategory.OST_Levels) \
				.WhereElementIsNotElementType() \
				.ToElements()

	elevations = [i.Elevation for i in allLevels]
	sortedLevels = [x for (y,x) in sorted(zip(elevations,allLevels))]
	sortedLevelNames = [i.Name for i in sortedLevels]
	index = sortedLevelNames.index(e.Name)
	if index + 1 >= len(sortedLevels):
		return None
	else:
		return sortedLevels[index+1]

try:
	errorReport = None
	output = ProcessList(GetLevelAbove, levels)
except:
	# if error accurs anywhere in the process catch it
	import traceback
	errorReport = traceback.format_exc()

#Assign your output to the OUT variable
if errorReport == None:
	OUT = output
else:
	OUT = errorReport
# ----------------------------------------
get_builtin_parameter_values_7 = Python(IN[0]=code_block_3.out4, IN[1]=python_script_4)  # same code as get_builtin_parameter_values
code_block_12 = CodeBlock(x=get_builtin_parameter_values_7) { x*25.4*12; }
code_block_13 = CodeBlock(x=code_block_12) { x[-1]+400000; }
addItemToEnd = List.AddItemToEnd(item=code_block_13, list=code_block_12)
create = List.Create(item0=get_builtin_parameter_values_5, item1=code_block_9, item2=addItemToEnd, item3=sortByKey.sorted_list)

# group: Returns the levels to which the elements should belong according to their Z value
getLocation = Element.GetLocation(element=code_block_7.b)
Z = Point.Z(point=getLocation)
python_script_5 = Python(IN[0]=Z, IN[1]=create)
# ---------- python_script_5.python (24 lines) ----------
import clr
clr.AddReference('ProtoGeometry')
from Autodesk.DesignScript.Geometry import *
#The inputs to this node will be stored as a list in the IN variables.
dataEnteringNode = IN

efelev = IN[0]
levels = IN[1]
output = []

names = levels[0]
evel0 = levels[1]
elev1 = levels[2]

for x in efelev:
	if x < levels[1][0]:
		output += [levels[3][0]]
	else:
		for y in range(len(levels[1])):
			if levels[1][y] <= x < levels[2][y]:
				output += [levels[3][y]]
					
#Assign your output to the OUT variable.
OUT = output
# ----------------------------------------

# group: Checks if levels match, if they don't it returns an adjusted offset value for the elements that are on the wrong level
get_builtin_parameter_values_8 = Python(IN[0]=code_block_3.out5, IN[1]=code_block_7.b)  # same code as get_builtin_parameter_values
code_block_14 = CodeBlock(x=get_builtin_parameter_values_8) { x*25.4*12; }
get_builtin_parameter_values_9 = Python(IN[0]=code_block_3.out4, IN[1]=python_script_5)  # same code as get_builtin_parameter_values
code_block_15 = CodeBlock(x=get_builtin_parameter_values_9) { x*25.4*12; }
get_builtin_parameter_values_10 = Python(IN[0]=code_block_3.out1, IN[1]=code_block_7.b)  # same code as get_builtin_parameter_values
get_builtin_parameter_values_11 = Python(IN[0]=code_block_3.out4, IN[1]=get_builtin_parameter_values_10)  # same code as get_builtin_parameter_values
code_block_16 = CodeBlock(x=get_builtin_parameter_values_11) { x*25.4*12; }
python_script_6 = Python(IN[0]=code_block_14, IN[1]=code_block_15, IN[2]=code_block_16)
# ---------- python_script_6.python (21 lines) ----------
import clr
clr.AddReference('ProtoGeometry')
from Autodesk.DesignScript.Geometry import *
#The inputs to this node will be stored as a list in the IN variables.
dataEnteringNode = IN
efelev = IN[0]
rightlevel = IN[1]
wronglevel = IN[2]
indexlist = []
output = []

for x in range(len(rightlevel)):
	if rightlevel[x] == wronglevel[x]:
		output += [efelev[x]]
	else:
		rightoffset = efelev[x] + (wronglevel[x] - rightlevel[x])
		output.append(rightoffset)
		indexlist.append(x)

#Assign your output to the OUT variable.
OUT = output, indexlist
# ----------------------------------------

# group: Filter only the items that need to be changed
code_block_17 = CodeBlock(x=python_script_6) { x[1]; }
getItemAtIndex = List.GetItemAtIndex(list=code_block_7.b, index=code_block_17)
getItemAtIndex_2 = List.GetItemAtIndex(list=python_script_5, index=code_block_17)

# group: Change offset and level values in model
python_script_7 = Python(IN[0]=getItemAtIndex, IN[1]=getItemAtIndex_2)
# ---------- python_script_7.python (38 lines) ----------
import clr
clr.AddReference('RevitAPI')
from Autodesk.Revit.DB import *

clr.AddReference("RevitNodes")
import Revit
clr.ImportExtensions(Revit.Elements)
clr.ImportExtensions(Revit.GeometryConversion)

clr.AddReference("RevitServices")
import RevitServices
from RevitServices.Persistence import DocumentManager
from RevitServices.Transactions import TransactionManager

doc = DocumentManager.Instance.CurrentDBDocument

element = UnwrapElement(IN[0])
ref_level = UnwrapElement(IN[1])

TransactionManager.Instance.EnsureInTransaction(doc)

for i,x in enumerate(element):
	ref_levelid = ref_level[i].Id
	
	object_param_level = x.get_Parameter(BuiltInParameter.FAMILY_LEVEL_PARAM)

	object_level = doc.GetElement(object_param_level.AsElementId())

	object_param_offset = x.get_Parameter(BuiltInParameter.INSTANCE_FREE_HOST_OFFSET_PARAM)

	object_newoffset = object_param_offset.AsDouble() + object_level.Elevation - ref_level[i].Elevation

	object_param_level.Set(ref_levelid)
	object_param_offset.Set(object_newoffset)

TransactionManager.Instance.TransactionTaskDone()

OUT = element
# ----------------------------------------

# group: Returns the levels to which the elements should belong according to their Z value
getLocation_2 = Element.GetLocation(element=code_block_7.out0)
startPoint = Curve.StartPoint(curve=getLocation_2)
Z_2 = Point.Z(point=startPoint)
python_script_8 = Python(IN[0]=Z_2, IN[1]=create)  # same code as python_script_5

# group: Checks if levels match, if they don't it returns an adjusted offset value for the elements that are on the wrong level
get_builtin_parameter_values_12 = Python(IN[0]=code_block_3.out0, IN[1]=code_block_7.out0)  # same code as get_builtin_parameter_values
code_block_18 = CodeBlock(x=get_builtin_parameter_values_12) { x*25.4*12; }
get_builtin_parameter_values_13 = Python(IN[0]=code_block_3.out4, IN[1]=python_script_8)  # same code as get_builtin_parameter_values
code_block_19 = CodeBlock(x=get_builtin_parameter_values_13) { x*25.4*12; }
get_builtin_parameter_values_14 = Python(IN[0]=code_block_3.out2, IN[1]=code_block_7.out0)  # same code as get_builtin_parameter_values
get_builtin_parameter_values_15 = Python(IN[0]=code_block_3.out4, IN[1]=get_builtin_parameter_values_14)  # same code as get_builtin_parameter_values
code_block_20 = CodeBlock(x=get_builtin_parameter_values_15) { x*25.4*12; }
python_script_9 = Python(IN[0]=code_block_18, IN[1]=code_block_19, IN[2]=code_block_20)  # same code as python_script_6

# group: Filter only the items that need to be changed
code_block_21 = CodeBlock(x=python_script_9) { x[1]; }
getItemAtIndex_3 = List.GetItemAtIndex(list=code_block_7.out0, index=code_block_21)
getItemAtIndex_4 = List.GetItemAtIndex(list=python_script_8, index=code_block_21)

code_block_22 = CodeBlock(e=getItemAtIndex_4) { e.Id; }

# group: Change offset and reference level values in model
python_script_10 = Python(IN[0]=code_block_3.out2, IN[1]=getItemAtIndex_3, IN[2]=code_block_22)
# ---------- python_script_10.python (68 lines) ----------
# Copyright(c) 2019, Konrad K Sobon
# @arch_laboratory, http://archi-lab.net

import clr
import sys
pyt_path = r'C:\Program Files (x86)\IronPython 2.7\Lib'
sys.path.append(pyt_path)

clr.AddReference("RevitNodes")
import Revit
clr.ImportExtensions(Revit.Elements)

clr.AddReference("RevitServices")
import RevitServices
from RevitServices.Persistence import DocumentManager
from RevitServices.Transactions import TransactionManager
doc = DocumentManager.Instance.CurrentDBDocument

clr.AddReference("RevitAPI")
import Autodesk
from Autodesk.Revit.DB import *
import System

paramName = IN[0]

if not isinstance(IN[1], list):
	elements = [IN[1]]
else:
	elements = IN[1]

if not isinstance(IN[2], list):
	paramValues = [IN[2]]
else:
	paramValues = IN[2]

def GetBuiltInParam(paramName):
	builtInParams = System.Enum.GetValues(BuiltInParameter)
	test = []
	for i in builtInParams:
		if i.ToString() == paramName:
			test.append(i)
			break
		else:
			continue
	return test[0]

try:
	errorReport = None
	TransactionManager.Instance.EnsureInTransaction(doc)
	
	bipName = GetBuiltInParam(paramName)
	for i, j in zip(elements, paramValues):
		param = UnwrapElement(i).get_Parameter(bipName)
		if param.StorageType == StorageType.ElementId:
			id = ElementId(j)
			param.Set(id)
		else:
			param.Set(j)
	
	TransactionManager.Instance.TransactionTaskDone()
except:
	import traceback
	errorReport = traceback.format_exc()

if errorReport == None:
	OUT = IN[1]
else:
	OUT = errorReport
# ----------------------------------------
