# Dynamo graph BIM1_WorksetsCreationFromExcel.dyn (Dynamo 2.3.0.5885)

# note: MONITORING
# note: USER INTERFACE

# group: PACKAGE NAME
# note: Always name the specific package to facilitate debugging and deployment
# Exploding a package helps deployment to clients
# Example:
# Clockworks 1.5.5

# group: ACTION - DATA
# note: part of the script that affect data:
# Examples:
# ACTION - DATA - get parameter name from txt file

# group: MONITORING - description
# note: ckeck the integrity and consistency of data or geometry affected
# Examples:
# number of rooms matches number of parameters changed

# group: ACTION - GEOMETRY
# note: part of the script that affect  geometry:
# Examples:
# ACTION - GEOMETRY - translate geometry to new location

# group: UI
# note: User interface for the script: describe what the UI will do
# Example:
# UI - get shared parameter file path

# group: CONSTRAINT
# note: Fixed input that should not be set as inputs available through the dynamo player

# group: INPUT
# note: input by user that should be set as input for the dynamo player

# group: BIMOne
# note: Created by BIMOne
# Workset creation from excel worksets and parameters list
# note: Copyright:
# This script is provided "as-is" under MIT License
# note: EDITOR
# Jean-Marc Couffin - May 2019 - v1.1
# Jean-Marc Couffin - October 2019 - v1.2
# Jean-Marc Couffin - February 2020 - v1.3
# note: CREATOR
# Jean-Marc Couffin - July 2018 - v1.0
# Dynamo 2.0
# note: DEPENDANCIES
# CODE
# UI based on Data-shapes
# by Mostafa El Ayoubi
# https://data-shapes.io/

# group: INPUT Excel file path
file_path = Filename("..\PACK 04 _\Worksets.xlsx")

# group: UI - Nom de la base de données
# note: INPUT
code_block = CodeBlock { "Excel"; }
code_block_2 = CodeBlock { false; }
python_script = Python(IN[0]=code_block, IN[1]=file_path, IN[2]=code_block_2)
# ---------- python_script.python (17 lines) ----------
#Copyright (c) mostafa el ayoubi ,  2018
#Data-Shapes www.data-shapes.net , elayoubi.mostafa@gmail.com

class uitext():

    def __init__(self,inputname,defaultvalue,_isnum):
        self.inputname = inputname
        self.defaultvalue = defaultvalue
        self._isnum = _isnum

    def __repr__(self):
        return 'UI.Textbox input'
        
x = uitext(IN[0],IN[1],IN[2])


OUT = x
# ----------------------------------------
code_block_3 = CodeBlock { "Ok"; }
code_block_4 = CodeBlock { true; }
code_block_5 = CodeBlock { ""; }
code_block_6 = CodeBlock { Logo_optional: var = ""; }
code_block_7 = CodeBlock { null; }
code_block_8 = CodeBlock { "Annuler"; }
code_block_9 = CodeBlock { 0; }
code_block_10 = CodeBlock { 600; }
python_script_2 = Python(IN[0]=python_script, IN[1]=code_block_3, IN[2]=code_block_4, IN[3]=code_block_5, IN[4]=code_block_6, IN[5]=code_block_7, IN[6]=code_block_8, IN[7]=code_block_9, IN[8]=code_block_10)
# ---------- python_script_2.python (1504 lines) ----------
#Copyright (c) Data Shapes,  2018
#Data-Shapes www.data-shapes.net , elayoubi.mostafa@data-shapes.io @data_shapes
	
import clr
import sys
pyt_path = r'C:\Program Files (x86)\IronPython 2.7\Lib'
sys.path.append(pyt_path)
import os
import webbrowser
import unicodedata
import io
	
try:
	clr.AddReference('System.Windows.Forms')
	clr.AddReference('System.Drawing')
	clr.AddReference('System.Windows.Forms.DataVisualization')
	
	from System.Drawing import Point , Size , Graphics, Bitmap, Image, Font, FontStyle, Icon, Color, Region , Rectangle , ContentAlignment , SystemFonts
	from System.Windows.Forms import Application, DockStyle, Button, Form, Label, TrackBar , ToolTip, ColumnHeader, TextBox, CheckBox, FolderBrowserDialog, OpenFileDialog, DialogResult, ComboBox, FormBorderStyle, FormStartPosition, ListView, ListViewItem , SortOrder, Panel, ImageLayout, GroupBox, RadioButton, BorderStyle, PictureBox, PictureBoxSizeMode, LinkLabel, CheckState, ColumnHeaderStyle , ImageList, VScrollBar, DataGridView, DataGridViewSelectionMode, DataGridViewAutoSizeColumnsMode , DataGridViewClipboardCopyMode , TreeView , TreeNode , TreeNodeCollection , AutoScaleMode , Screen
	from System.Windows.Forms.DataVisualization.Charting import Chart , SeriesChartType
	from System.Collections.Generic import *
	from System.Collections.Generic import List as iList
	from System.Windows.Forms import View as vi
	clr.AddReference('System')
	from System import IntPtr , Char
	from System import Type as SType, IO
	from System.ComponentModel import Container
	clr.AddReference('System.Data')
	from System.Data import DataTable , DataView

	
	clr.AddReference('RevitAPIUI')
	from  Autodesk.Revit.UI import Selection , TaskDialog 
	from  Autodesk.Revit.UI.Selection import ISelectionFilter
	
	importcolorselection = 0
	
	try:
		from  Autodesk.Revit.UI import ColorSelectionDialog
	except:
		importcolorselection = 1
	
	clr.AddReference('RevitNodes')
	import Revit
	clr.ImportExtensions(Revit.Elements)
	clr.ImportExtensions(Revit.GeometryConversion)
	
	clr.AddReference('RevitServices')
	from RevitServices.Persistence import DocumentManager
	doc = DocumentManager.Instance.CurrentDBDocument
	uidoc = DocumentManager.Instance.CurrentUIApplication.ActiveUIDocument

	clr.AddReference('RevitAPI')
	from Autodesk.Revit.DB import FilteredElementCollector , View , ViewType , ElementId , FamilyInstance , Document , UnitType , UnitUtils
	dbviews = [v for v in FilteredElementCollector(doc).OfClass(View).ToElements() if (v.ViewType == ViewType.FloorPlan or v.ViewType == ViewType.CeilingPlan or v.ViewType == ViewType.Section or v.ViewType == ViewType.Elevation or v.ViewType == ViewType.ThreeD)]
	viewindex = 0
	
	clr.AddReference('ProtoGeometry')
	from Autodesk.DesignScript.Geometry import Point as dsPoint

	from System.Reflection import Assembly
	import xml.etree.ElementTree as et
	
	UIunit = Document.GetUnits(doc).GetFormatOptions(UnitType.UT_Length).DisplayUnits
	
	import re	
	def regexEndNum(input):
		try:
			return 	re.search('(\d+)$', input).group(0)
		except:
			return ""

	def iterateThroughNodes(collection,li):
		if hasattr(collection,'Nodes'):
			ntest = collection.Nodes
			if len(ntest) > 0:
				for i in ntest:
					iterateThroughNodes(i,li)
			else:
				if collection.Checked:
					li.append(collection.Tag)
		return li
		
	class selectionfilter(ISelectionFilter):
		def __init__(self,category):
			self.category = category
		def AllowElement(self,element):
			if element.Category.Name in [c.Name for c in self.category]:
				return True
			else:
				return False
		def AllowReference(reference,point):
			return False
	
	class MultiTextBoxForm(Form):
		
	    def __init__(self):
	        self.Text = 'BIM One Inc. | Create worksets from excel data | UI powered by Datashapes'
	        self.output = []
	        self.values = []
	        self.cancelled = False
	
	    def setclose(self, sender, event):
	    	cbindexread = 0
	    	if sender.Name != "Cancel":
	    		for f in self.output:
	    			if f.GetType() == myTextBox:
	    				if f._isNum :
	    					val = float(f.Text)
	    				else:
	    					val = f.Text
	    				self.values.append(val)
	    			if f.GetType() == CheckBox:
	    				self.values.append(f.Checked)
	    			if f.GetType() == Button:
	    				if isinstance(f.Tag ,list):
	    					self.values.append([e for e in f.Tag if e.__class__.__name__ != "Category"])
	    				else:	    					
	    					if f.Tag.__class__.__name__ != "Category":
	    						self.values.append(f.Tag)
	    					else:
    							self.values.append([])

	    			if f.GetType() == ComboBox:
	    				try:
	    					key = f.Text
	    					self.values.append(f.Tag[key])
	    				except:
	    					self.values.append(None)
	    			if f.GetType() == mylistview:
	    				self.values.append([f.Values[i.Text] for i in f.CheckedItems])
	    			if f.GetType() == mytrackbar:
	    				self.values.append(f.startval+f.Value*f.step)
	    			if f.GetType() == mygroupbox:
	    				try:
	    					key = [j.Text for j in f.Controls if j.Checked == True][0]
	    					self.values.append(f.Tag[key])
	    				except:
	    					self.values.append(None)
	    			if f.GetType() == myDataGridView:
	    				f.EndEdit()
	    				dsrc = f.DataSource
	    				out = []
	    				colcount = f.ColumnCount
	    				rowcount = f.RowCount - 1
	    				if f.Tag:
		    				l = []
	    					for i in range(colcount):	    						
	    						l.append(dsrc.Columns[i].ColumnName)
	    					out.append(l)	    						
		    				for r in range(rowcount):
		    					l = []
		    					for i in range(colcount):
		    						l.append(dsrc.DefaultView[r].Row[i])
		    					out.append(l)
	    				else: 
		    				for r in range(rowcount):
		    					l = []
		    					for i in range(colcount):
		    						l.append(dsrc.DefaultView[r].Row[i])
		    					out.append(l)
	    				self.values.append(out)
	    			if f.GetType() == TreeView:
	    				ls = []
	    				nds = f.Nodes[0]
	    				iterateThroughNodes(nds,ls)
	    				self.values.append(ls)
	    			if f.GetType() == GroupBox:
	    				rb = [c for c in f.Controls if c.GetType() == RadioButton and c.Checked][0]
	    				self.values.append(rb.Text)
	    				f.Controls.Remove(rb)
	    	else:
	    		self.values = None
	    		self.cancelled = True
	    	self.Close()
	
	    def reset(self, sender, event):
			pass
	
	    def openfile(self, sender, event):
			ofd = OpenFileDialog()
			dr = ofd.ShowDialog()
			if dr == DialogResult.OK:
				sender.Text = ofd.FileName
				sender.Tag = ofd.FileName

	    def exportToExcel(self, sender, event):
	    	#importing Excel IronPython libraries
	    	clr.AddReferenceByName('Microsoft.Office.Interop.Excel, Version=11.0.0.0, Culture=neutral, PublicKeyToken=71e9bce111e9429c')
	    	from Microsoft.Office.Interop import Excel
	    	ex = Excel.ApplicationClass()
	    	ex.Visible = sender.Tag[1]
	    	ex.DisplayAlerts = False
	    	fbd = FolderBrowserDialog()
	    	fbd.SelectedPath = sender.Text
	    	parent = sender.Parent
	    	fptextbox = parent.GetChildAtPoint(Point(parent.Location.X,sender.Location.Y+5*yRatio))
	    	dataGrid = parent.GetChildAtPoint(Point(parent.Location.X,parent.Location.Y+23*xRatio))
	    	dataTable = dataGrid.DataSource
	    	fptext = fptextbox.Text
	    	titletext = parent.GetChildAtPoint(Point(0,0)).Text
	    	dr = fbd.ShowDialog()
	    	frstRwTtle = sender.Tag[0]
	    	if frstRwTtle:
	    		_header = Excel.XlYesNoGuess.xlYes
	    	else:
	    		_header = Excel.XlYesNoGuess.xlNo
	    	if dr == DialogResult.OK:
	    		workbk = ex.Workbooks.Add()
	    		worksheet = workbk.Worksheets.Add()
	    		#Writing title and doc info
	    		if sender.Tag[2]:
		    		titleCell = worksheet.Cells[1,1]
		    		worksheet.Cells[2,1].Value2 = sender.Tag[3]
		    		titleCell.Value2 = titletext
		    		titleCell.Font.Size = 18
		    		titleCell.Font.Bold = True
		    		startR = 3
		    		endR = 3
		    	else:
		    		startR = 1
		    		endR = 0	
		    	if frstRwTtle:
		    		for j in range(0,dataTable.Columns.Count):
		    			worksheet.Cells[startR,j+1] = dataTable.Columns[j].ColumnName		    	
		    		for i in range(0,dataTable.Rows.Count):
		    			for j in range(0,dataTable.Columns.Count):
			    			worksheet.Cells[i+startR+1,j+1] = dataTable.DefaultView[i].Row[j].ToString()
		    		xlrange = ex.get_Range(worksheet.Cells[startR,1],worksheet.Cells[dataTable.Rows.Count+endR+1,dataTable.Columns.Count])			    			
		    	else :
		    		for i in range(0,dataTable.Rows.Count):
		    			for j in range(0,dataTable.Columns.Count):
			    			worksheet.Cells[i+startR,j+1] = dataTable.DefaultView[i].Row[j].ToString()		    	
		    		xlrange = ex.get_Range(worksheet.Cells[startR,1],worksheet.Cells[dataTable.Rows.Count+endR,dataTable.Columns.Count])
		    	xlrange.Columns.AutoFit()
		    	worksheet.ListObjects.Add(Excel.XlListObjectSourceType.xlSrcRange, xlrange, SType.Missing, _header, SType.Missing).Name = "DataShapesTable"
		    	worksheet.ListObjects["DataShapesTable"].TableStyle =  "TableStyleMedium16"
	    		workbk.SaveAs(fbd.SelectedPath + "\\" + fptext)
	    		if not sender.Tag[1]:
	    			workbk.Close()
	    			ex.Quit()

	    def startCell(self, sender, event ):
			sender.startcell["X"] = event.ColumnIndex
			sender.startcell["Y"] = event.RowIndex	

	    def endCell(self, sender, event ):
	    	try:
				sender.endcell["X"] = event.ColumnIndex
				sender.endcell["Y"] = event.RowIndex 
				startval = sender.Rows[sender.startcell["Y"]].Cells[sender.startcell["X"]].Value
				endNum = regexEndNum(startval)
				if endNum != "":
					if sender.endcell["Y"] == sender.startcell["Y"]:
						for e,i in enumerate(range(sender.startcell["X"],sender.endcell["X"] + 1)):
							sender.Rows[sender.startcell["Y"]].Cells[i].Value = startval[:-len(endNum)] + str(int(endNum) + e)
					elif sender.endcell["X"] == sender.startcell["X"]:
						for e,i in enumerate(range(sender.startcell["Y"],sender.endcell["Y"] + 1)):
							sender.Rows[i].Cells[sender.endcell["X"]].Value = startval[:-len(endNum)] + str(int(endNum) + e)
				else:				
					if sender.endcell["Y"] == sender.startcell["Y"]:
						for i in range(sender.startcell["X"],sender.endcell["X"] + 1):
							sender.Rows[sender.startcell["Y"]].Cells[i].Value = startval
					elif sender.endcell["X"] == sender.startcell["X"]:
						for i in range(sender.startcell["Y"],sender.endcell["Y"] + 1):
							sender.Rows[i].Cells[sender.endcell["X"]].Value = startval
	    	except:
	    		pass
	    		    	
	    def startRowDrag(self, sender, event ):
	    	shmak
			
	    def opendirectory(self, sender, event):
			fbd = FolderBrowserDialog()
			fbd.SelectedPath = sender.Text
			dr = fbd.ShowDialog()
			if dr == DialogResult.OK:
				sender.Text = fbd.SelectedPath
				sender.Tag = fbd.SelectedPath
	
	    def pickobjects(self, sender, event):
			for c in self.Controls:
				c.Enabled = False
			try:
				sel = uidoc.Selection.PickObjects(Selection.ObjectType.Element,'')
				selelem = [doc.GetElement(s.ElementId) for s in sel]
				sender.Tag = (selelem)
			except:
				pass
			for c in self.Controls:
				c.Enabled = True
	    def pickobjectsordered(self, sender, event):
			for c in self.Controls:
				c.Enabled = False
			output = []
			test = True
			TaskDialog.Show("Data|Shapes", 'Pick elements in order, then hit ESC to exit.')
			while test:
				try:
					sel = doc.GetElement(uidoc.Selection.PickObject(Selection.ObjectType.Element, 'Pick elements in order').ElementId)
					output.append(sel.ToDSType(True))
				except : 
					test = False
				sender.Tag = output
			for c in self.Controls:
				c.Enabled = True
	    
	    def pickobjectsofcatordered(self, sender, event):
			for c in self.Controls:
				c.Enabled = False
			output = []
			test = True
			if isinstance(sender.Tag,list):			
				category = UnwrapElement(sender.Tag)
			else:
				category = [UnwrapElement(sender.Tag)]
			TaskDialog.Show("Data|Shapes", 'Select %s in order, then press ESC to exit.' %(', '.join([c.Name for c in category])))
			while test:
				try:
					selfilt = selectionfilter(category)
					sel = doc.GetElement(uidoc.Selection.PickObject(Selection.ObjectType.Element,selfilt, 'Select %s' %(', '.join([c.Name for c in category]))).ElementId)				
					output.append(sel.ToDSType(True))
				except : 
					test = False
				sender.Tag = (output)
			for c in self.Controls:
				c.Enabled = True
			
	    def picklinkedobjects(self, sender, event):
			#This part was made easier by Dimitar Venkov's work
			for c in self.Controls:
				c.Enabled = False
			try:
				linkref = uidoc.Selection.PickObject(Selection.ObjectType.Element,'Select the link instance.')
				link = doc.GetElement(linkref.ElementId).GetLinkDocument()
				td = TaskDialog.Show('Data-Shapes','Select the linked elements and press Finish.')
				sel = uidoc.Selection.PickObjects(Selection.ObjectType.LinkedElement,'Select the linked elements and press Finish.')
				selelem = [link.GetElement(s.LinkedElementId) for s in sel]
				sender.Tag = (selelem)
			except:
				pass
			for c in self.Controls:
				c.Enabled = True		

	    def pickobject(self, sender, event):
			for c in self.Controls:
				c.Enabled = False
			try:
				sel = uidoc.Selection.PickObject(Selection.ObjectType.Element,'')
				selelem = doc.GetElement(sel.ElementId) 
				sender.Tag = (selelem)
			except:
				pass
			for c in self.Controls:
				c.Enabled = True
			
	    def picklinkedobject(self, sender, event):
			#This part was made easier by Dimitar Venkov's work
			for c in self.Controls:
				c.Enabled = False
			try:
				linkref = uidoc.Selection.PickObject(Selection.ObjectType.Element,'Select the link instance.')
				link = doc.GetElement(linkref.ElementId).GetLinkDocument()
				td = TaskDialog.Show('Data-Shapes','Select the linked element.')
				sel = uidoc.Selection.PickObject(Selection.ObjectType.LinkedElement,'Select the linked element.')
				selelem = link.GetElement(sel.LinkedElementId)
				sender.Tag = (selelem)
			except:
				pass				
			for c in self.Controls:
				c.Enabled = True
			
	    def pickobjectsofcat(self, sender, event):
			for c in self.Controls:
				c.Enabled = False
			if isinstance(sender.Tag,list):	    
				category = UnwrapElement(sender.Tag)
			else:
				category = [UnwrapElement(sender.Tag)]
			try:
				selfilt = selectionfilter(category)
				sel = uidoc.Selection.PickObjects(Selection.ObjectType.Element,selfilt,'Select %s' %(', '.join([c.Name for c in category])))
				selelem = [doc.GetElement(s.ElementId) for s in sel]
				sender.Tag = (selelem)
			except:
				pass
			for c in self.Controls:
				c.Enabled = True

	    def pickobjectofcat(self, sender, event):
			for c in self.Controls:
				c.Enabled = False
			if isinstance(sender.Tag,list):	    
				category = UnwrapElement(sender.Tag)
			else:
				category = [UnwrapElement(sender.Tag)]
			try:
				selfilt = selectionfilter(category)
				sel = uidoc.Selection.PickObject(Selection.ObjectType.Element,selfilt,'Select %s' %(', '.join([c.Name for c in category])))
				selelem = doc.GetElement(sel.ElementId) 
				sender.Tag = (selelem)
			except:
				pass
			for c in self.Controls:
				c.Enabled = True
			
	    def pickfaces(self, sender, event):
			faces = []	    	
			for c in self.Controls:
				c.Enabled = False
			try:
				selface = uidoc.Selection.PickObjects(Selection.ObjectType.Face,'')
				for s in selface:
					f = uidoc.Document.GetElement(s).GetGeometryObjectFromReference(s).ToProtoType(True)
					[i.Tags.AddTag("RevitFaceReference", s) for i in f]
					faces.append(f)
				sender.Tag = [i for j in faces for i in j]
			except:
				pass
			for c in self.Controls:
				c.Enabled = True
				
	    def pickpointsonface(self, sender, event):
			faces = []	    	
			for c in self.Controls:
				c.Enabled = False
			selpoints = uidoc.Selection.PickObjects(Selection.ObjectType.PointOnElement,'')
			points = []
			for s in selpoints:
				pt = s.GlobalPoint
				points.append(dsPoint.ByCoordinates(UnitUtils.ConvertFromInternalUnits(pt.X,UIunit),UnitUtils.ConvertFromInternalUnits(pt.Y,UIunit),UnitUtils.ConvertFromInternalUnits(pt.Z,UIunit)))
			sender.Tag = points
			for c in self.Controls:
				c.Enabled = True
				
	    def pickedges(self, sender, event):
			edges = []
			for c in self.Controls:
				c.Enabled = False	
			try:				
				seledge = uidoc.Selection.PickObjects(Selection.ObjectType.Edge,'')
				for s in seledge:
					e = uidoc.Document.GetElement(s).GetGeometryObjectFromReference(s).AsCurve().ToProtoType(True)
					e.Tags.AddTag("RevitFaceReference", s)
					edges.append(e)
				sender.Tag = edges
			except:
				pass
			for c in self.Controls:
				c.Enabled = True

	    def colorpicker(self, sender, event):
			dialog = ColorSelectionDialog()
			selection = ColorSelectionDialog.Show(dialog)
			selected = dialog.SelectedColor
			sender.Tag = selected
			sender.BackColor = Color.FromArgb(selected.Red,selected.Green,selected.Blue)
			sender.ForeColor = Color.FromArgb(selected.Red,selected.Green,selected.Blue)
	
	    def topmost(self):
			self.TopMost = True
	
	    def lvadd(self, sender, event):
			sender.Tag = [i for i in sender.CheckedItems]
			
	    def scroll(self, sender, event):
			parent = sender.Parent
			child = parent.GetChildAtPoint(Point(0,5*yRatio))
			child.Text = str(sender.startval+sender.Value*sender.step)

	    def openurl(self, sender, event):
			webbrowser.open(sender.Tag)
	
	    def selectall(self, sender, event):
			if sender.Checked:
				parent = sender.Parent
				listview = parent.GetChildAtPoint(Point(0,0))
				for i in listview.Items:
					i.Checked = True
			else:
				pass
				
	    def selectnone(self, sender, event):
			if sender.Checked:
				parent = sender.Parent
				listview = parent.GetChildAtPoint(Point(0,0))
				for i in listview.Items:
					i.Checked = False
			else:
				pass		

	    def updateallnone(self, sender, event):
	    	try:
	    		parent = sender.Parent
	    		rball = parent.GetChildAtPoint(Point(0,sender.Height + 5*yRatio))
	    		rbnone = parent.GetChildAtPoint(Point(80 * xRatio,sender.Height + 5*yRatio))
	    		if sender.CheckedItems.Count == 0 and event.NewValue == CheckState.Unchecked:
	    			rbnone.Checked = False
	    			rball.Checked = False
	    		elif sender.CheckedItems.Count == sender.Items.Count and event.NewValue == CheckState.Unchecked:
	    			rball.Checked = False
	    			rbnone.Checked = False
	    		elif sender.CheckedItems.Count == sender.Items.Count-1 and event.NewValue == CheckState.Checked:
	    			rball.Checked = True
	    			rbnone.Checked = False
	    		elif sender.CheckedItems.Count == 1 and event.NewValue == CheckState.Unchecked:
	    			rball.Checked = False
	    			rbnone.Checked = True	    	
	    		else :
	    			rball.Checked = False
	    			rbnone.Checked = False
	    	except:
	    		pass

	    def zoomcenter(self, sender, event ):
			if event.X > 15:	    
				try:
					element = doc.GetElement(uidoc.Selection.GetElementIds()[0])
					uidoc.ShowElements(element)
				except:
					pass
			else:
				pass
				
			
	    def setviewforelement(self, sender, event ):    
			if event.X > 15*xRatio:	    		
				try:
					item = sender.GetItemAt(event.X,event.Y).Text
					element = UnwrapElement(sender.Values[item])
					try:
						viewsforelement = [v for v in dbviews if (not v.IsTemplate) and (element.Id in [e.Id for e in FilteredElementCollector(doc,v.Id).OfClass(element.__class__).ToElements()])]
					except:
						viewsforelement = [v for v in dbviews if (not v.IsTemplate) and (element.Id in [e.Id for e in FilteredElementCollector(doc,v.Id).OfClass(FamilyInstance).ToElements()])]
					global viewindex
					dbView = viewsforelement[viewindex]
					id = [element.Id]
					icollection = iList[ElementId](id)
					uidoc.Selection.SetElementIds(icollection)
				except:
					pass
			else:	    
				pass


	    def CheckChildren(self, sender, event ):
			evNode = event.Node	    
			checkState = evNode.Checked	
			for n in event.Node.Nodes:	   	
				n.Checked = checkState			
				
	    def ActivateOption(self, sender, event ):
	    	parent = sender.Parent
	    	associatedControls = [p for p in parent.Controls if p.Name == sender.Text and p.GetType() == Panel][0]
	    	restofcontrols = [p for p in parent.Controls if p.Name != sender.Text and p.GetType() == Panel]
	    	if sender.Checked:
	    		associatedControls.Enabled = True
	    		for c in restofcontrols:
	    			c.Enabled = False
	    		parent.Tag = sender.Text
	    		
	    def showtooltip(self, sender, event ):
	    	ttp = ToolTip()
	    	ttp.AutoPopDelay = 10000
	    	ttp.SetToolTip(sender , sender.Tag)	

	    def numsOnly(self, sender, event ):
	    	if Char.IsDigit(event.KeyChar)==False and event.KeyChar != "." and Char.IsControl(event.KeyChar)==False:
	    		event.Handled = True				
			

	class mylistview(ListView):
	
		def __init__(self):
			self.Values = []

	class mytrackbar(TrackBar):
	
		def __init__(self,startval,step):
			self.startval = startval
			self.step = step

	class myDataGridView(DataGridView):
	
		def __init__(self):
			self.startcell = {}
			self.endcell = {}
			
	class mygroupbox(GroupBox):
	
		def __init__(self):
			self.Values = []
			
	class myTextBox(TextBox):
	
		def __init__(self):
			self._isNum = False	
			
	#Form initialization
	
	form = MultiTextBoxForm()
	xRatio = Screen.PrimaryScreen.Bounds.Width/1920
	if xRatio == 0:
		xRatio = 1
	yRatio = Screen.PrimaryScreen.Bounds.Height/1080
	if yRatio == 0:
		yRatio = 1
	form.topmost()	
	form.ControlBox = True
	xlabel = 25 * xRatio
	xinput = 150 * xRatio
	formy = 10 * yRatio
	if IN[8] * xRatio > (350 * xRatio):	formwidth = IN[8] * xRatio
	else: formwidth = 350 * xRatio
	fields = []
	error = 0
	
	#Description 
	
	if IN[3] != "":
		des = Label()
		des.Location = Point(xlabel,formy)
		des.Font = Font("Arial", 15,FontStyle.Bold)		
		des.AutoSize = True
		des.MaximumSize = Size(formwidth - (2 * xlabel)*xRatio,0)
		des.Text = IN[3]
		form.Controls.Add(des)
		formy = des.Bottom + (15*xRatio)
	formheaderheight = formy
	
	#Input form
	
	# Create a container panel for all inputs
	body = Panel()
	body.Location = Point(0,formy)
	body.Width = formwidth - 15*xRatio
	
	
	# Process form inputs
	if isinstance(IN[0],list):
		inputtypes = IN[0]
	else:
		inputtypes = [IN[0]]
	# This definition is to handle the sorting of special characters
	def remove_accents(input_str):
	    nfkd_form = unicodedata.normalize('NFKD', input_str)
	    only_ascii = nfkd_form.encode('ASCII', 'ignore')
	    return only_ascii	

	#Adding Logo 
	#default logo in case no input	
	def getImageByName(ImName):
		dynamo = Assembly.Load('DynamoCore')
		version = str(dynamo.GetName().Version)[:3]		
		dynPath = os.getenv('APPDATA')+"\\Dynamo\Dynamo Revit\\" + version 
		root = et.parse(dynPath + "\DynamoSettings.xml").getroot()
		logopaths = []
		for child in root:
			if child.tag == "CustomPackageFolders":
				for path in child:
					logopaths.append(path.text + "\packages\\" + ImName)
					logopaths.append(path.text + "\\" + ImName)
		deflogopath = ""
		for path in logopaths:
			if deflogopath == "":
				if os.path.isfile(path):
					deflogopath = path
					try:
						ima = Image.FromFile(deflogopath)
						bmp = Bitmap.FromFile(deflogopath)
						return ima,bmp
					except: 
						pass
						
	try:
		if IN[4] != '':
			try:
				ima = Image.FromFile(IN[4])
				bmp = Bitmap.FromFile(IN[4])
			except:
				ima = IN[4]
				bmp = IN[4]

		else :
			_ims = getImageByName("logo.png")
			ima = _ims[0]
			bmp = _ims[1]
			
		logo = Panel()
		if IN[6] == None:
			xlogo = 20 * xRatio
			ylogo = formy+ 10*yRatio
		else:
			xlogo = 30 * xRatio
			ylogo = formy
		size = 110 * xRatio
		logo = PictureBox()
		ratio = (ima.Height)/(ima.Width)
		h = float(ima.Height)
		w = float(ima.Width)
		ratio = h/w
		logo.Size = Size(size,size*ratio)
		scaledimage = Bitmap(size,size*ratio)
		gr = Graphics.FromImage(scaledimage)
		gr.DrawImage(ima,0,0,size,size*ratio)
		logo.Image = ima
		logo.SizeMode = PictureBoxSizeMode.Zoom
		form.Controls.Add(logo)
		logo.Location = Point(xlogo,ylogo)
		
		
		#Setting icon 
		thumb = bmp.GetThumbnailImage(64, 64, bmp.GetThumbnailImageAbort,IntPtr.Zero)
		thumb.MakeTransparent();
		icon = Icon.FromHandle(thumb.GetHicon())
		form.Icon = icon

	except :
		logo = Panel()
		logo.Width = 110 * xRatio
		logo.Height = 110 * yRatio
	
	def addinput(formbody,inputs,starty,xinput,rightmargin,labelsize,importcolorselection):
		y = starty
		for j in inputs:
			label = Label()
			label.Location = Point(xlabel,y+4*yRatio)
			label.AutoSize = True
			label.MaximumSize = Size(labelsize,0)
			if j.__class__.__name__ == 'listview' and j.element_count > 0:
				label.Text = j.inputname + '\n(' + str(j.element_count) + ' element' + ("s" if j.element_count > 1 else "") + ')'
			else:
				try:
					label.Text = j.inputname
				except:
					pass
			formbody.Controls.Add(label)
	
			if j.__class__.__name__ == 'dropdown':
				cb = ComboBox()
				if j.inputname != "":
					cb.Width = formwidth - rightmargin - xinput
					cb.Location = Point(xinput,y)
				else:
					cb.Width = formwidth - rightmargin - xlabel
					cb.Location = Point(xlabel,y)
				cb.Sorted = j._sorted
				[cb.Items.Add(i) for i in j.keys() if not (i == 'inputname' or i == 'height' or i == 'defaultvalue' or i == 'highlight' or i == '_sorted' )]
				cb.Tag = j
				if j.defaultvalue != None:
					defindex = [i for i in cb.Items].index([i for i in j.keys() if not (i == 'inputname' or i == 'height' or i == 'defaultvalue' or i == 'highlight' or i == '_sorted' )][j.defaultvalue])
					cb.SelectedIndex = defindex
				formbody.Controls.Add(cb)
				form.output.append(cb)
				y = label.Bottom + 25 * yRatio
			#CHARTS is a work in progress
			'''
			if j.__class__.__name__ == 'uichart':
				ch = Chart()
				ch.Width = formwidth - rightmargin - xlabel
				ch.Location = Point(xlabel,y)
				ch.Height = 600 * yRatio
				ch.Series.Add("test")
				ch.Series["test"].XValueMember = "Date"
				ch.Series["test"].YValueMembers = "Percent"
				ch.Series[0].ChartType = SeriesChartType.ChartType.Bar
				dt = DataTable()
				dl = j.datalist
				for rindex in range(rngstart,len(dl)):
					row = dt.NewRow()
					for i in range(len(dl[rindex])):
						row[i] = dl[rindex][i]
					dt.Rows.Add(row)
				ch.DataSource = table
				ch.DataBind()
				formbody.Controls.Add(ch)
				y = ch.Bottom + 25 * yRatio
			'''
			if j.__class__.__name__ == 'uitreeview':
				tv = TreeView()
				tv.CheckBoxes = True
				titles = j._hastitles
				if j.inputname != "":
					tv.Width = formwidth - rightmargin - xinput
					tv.Location = Point(xinput,y)
				else:
					tv.Width = formwidth - rightmargin - xlabel
					tv.Location = Point(xlabel,y)
				tv.Height = j._height
				def treeIterationTitle(control, input):
					if isinstance(input,list):
						try:
							currentNode = TreeNode(remove_accents(input[0].ToString()))
							currentNode.Tag = ""
							input.pop(0)
						except:
							currentNode = TreeNode(control.Text +"."+ str(len(control.Nodes)+1))
							currentNode.Tag = ""
						control.Nodes.Add(currentNode)
						for i in input:
							treeIterationTitle(currentNode, i)
					else:
						item = TreeNode(remove_accents(input.ToString()))
						item.Tag = input
						control.Nodes.Add(item)	
				def treeIteration(control, input):
					if isinstance(input,list):
						currentNode = TreeNode(control.Text +"."+ str(len(control.Nodes)+1))
						currentNode.Tag = input
						control.Nodes.Add(currentNode)
						for i in input:
							treeIteration(currentNode, i)
					else:
						item = TreeNode(remove_accents(input.ToString()))
						item.Tag = input
						control.Nodes.Add(item)
				currentNode = TreeNode("List1")
				currentNode.Expand()				
				if titles:
					tv.Nodes.Add(currentNode)								
					for dl in j.datalist:
						treeIterationTitle(currentNode,dl)	
				else:
					tv.Nodes.Add(currentNode)								
					for dl in j.datalist:
						treeIteration(currentNode,dl)
				tv.AfterCheck += form.CheckChildren						
				formbody.Controls.Add(tv)
				form.output.append(tv)
				y = tv.Bottom + 25 * yRatio
			elif j.__class__.__name__ == 'listview':
				lvp = Panel()
				if j.inputname != "":
					lvp.Location = Point(xinput,y)
					lvp.Width = formwidth - rightmargin - xinput				
				elif j.inputname == "" and j.element_count != 0:
					lvp.Location = Point(xlabel,y+35*yRatio)
					lvp.Width = formwidth - rightmargin - xlabel
				else : 
					lvp.Location = Point(xlabel,y)
					lvp.Width = formwidth - rightmargin - xlabel				
				lvp.Height = j.height * yRatio + 25 * yRatio
				#Creating the listview box
				lv = mylistview()
				lv.Scrollable = True
				dummyheader = ColumnHeader()
				dummyheader.Text = ""
				dummyheader.Name = ""
				dummyheader.Width = -2 * xRatio
				lv.HeaderStyle = ColumnHeaderStyle.None
				lv.Columns.Add(dummyheader)
				lv.Values = j
				if not j.display_mode:
					lv.CheckBoxes = True
				lv.View = vi.Details
				lvItems =  [i for i in j.keys() if not (i == 'inputname' or i == 'height' or i == 'highlight' or i == 'display_mode' or i == 'element_count' or i == 'default_values' or i == 'sorted' or i == 'showId')]
				if j.sorted :
					lvItems = sorted(lvItems,key = remove_accents)
				else:
					pass
				[lv.Items.Add(i) for i in lvItems]
				lv.Location = Point(0,0)
				if j.inputname != "" and j.element_count != 0:
					lv.Width = formwidth - rightmargin - xinput
				elif j.inputname != "" and j.element_count == 0:
					lv.Width = formwidth - rightmargin - xinput
				else:
					lv.Width = formwidth - rightmargin - xlabel
				lv.Height = j.height * yRatio
				lv.Scrollable = True
				lv.ItemCheck += form.updateallnone
				for i in j.default_values:
					defInd = lvItems.index([x for x in j.keys() if not (x == 'inputname' or x == 'height' or x == 'highlight' or x == 'display_mode' or x == 'element_count' or x == 'default_values' or x == 'sorted' or x == 'showId')][i])
					lv.Items[defInd].Checked = True
				#Click listview items to hilight and center in appropriate view
				if j.highlight :
					lv.MouseDown += form.setviewforelement
					lv.MouseUp += form.zoomcenter
					items = list(lv.Items)
					lv.FullRowSelect = True
					del items[::2]
					for item in items:
						item.BackColor = Color.FromArgb(230,243,255)
				#Creating select all and select none radiobuttons
				if not j.display_mode:
					rball = RadioButton()
					rball.Location = Point(0,(j.height+5)*yRatio)
					rball.Width = 100 * xRatio
					rball.Height = 20 * yRatio
					rball.Font = SystemFonts.DefaultFont
					rball.Text = "Select all"
					rball.Click += form.selectall
					rbnone = RadioButton()
					rbnone.Location = Point(105 * xRatio,(j.height+5)*yRatio)
					rbnone.Width = 100 * xRatio
					rbnone.Height = 20 * yRatio
					rbnone.Font = SystemFonts.DefaultFont
					rbnone.Text = "Select none"			
					rbnone.Click += form.selectnone			
				#Adding controls to panel
				lvp.Controls.Add(lv)
				if not j.display_mode:
					lvp.Controls.Add(rball)
					lvp.Controls.Add(rbnone)
				formbody.Controls.Add(lvp)
				if not j.display_mode:
					form.output.append(lv)
				y = lvp.Bottom + 25 * yRatio
			elif j.__class__.__name__ == 'uitext':
				tb = myTextBox()
				tb.Text = j.defaultvalue
				if j.inputname != "":
					tb.Width = formwidth  - rightmargin - xinput
					tb.Location = Point(xinput,y)
				else:
					tb.Width = formwidth - rightmargin - xlabel
					tb.Location = Point(xlabel,y)
				if j._isnum:
					tb._isNum = True
					tb.KeyPress += form.numsOnly
				formbody.Controls.Add(tb)
				formbody.Controls.Add(label)
				form.output.append(tb)
				y = label.Bottom + 25 * yRatio
			elif j.__class__.__name__ == 'uimultilinetext':
				tb = myTextBox()
				tb.Text = j.defaultvalue
				tb.Multiline  = True
				tb.Height = j._height * yRatio
				if j.inputname != "":
					tb.Width = formwidth  - rightmargin - xinput
					tb.Location = Point(xinput,y)
				else:
					tb.Width = formwidth - rightmargin - xlabel
					tb.Location = Point(xlabel,y)
				if j._isnum:
					tb._isNum = True
					tb.KeyPress += form.numsOnly
				formbody.Controls.Add(tb)
				formbody.Controls.Add(label)
				form.output.append(tb)
				y = tb.Bottom + 25 * yRatio								
			elif j.__class__.__name__ == 'tableview':
				#Creating grouping panel
				tvp = Panel()
				tvp.Location = Point(xlabel,y)
				tvp.Width = formwidth - rightmargin - xlabel
				if (50 + len(j.dataList) * 15) * yRatio > 800 * yRatio:
					autoheight = 800 * yRatio
				else:
					autoheight = (50 + len(j.dataList) * 15	) * yRatio			
				tvp.Height = autoheight + 73 * yRatio
				#Creating title
				titlep = Label()
				titlep.Text = j._tabletitle
				titlep.Width = formwidth - rightmargin - xlabel
				titlep.BackColor = Color.FromArgb(153,180,209)
				titlep.Font = Font("Arial", 11, FontStyle.Bold)
				titlep.TextAlign = ContentAlignment.MiddleLeft
				titlep.BorderStyle = BorderStyle.FixedSingle
				titlep.Location = Point(0,0)
				tvp.Controls.Add(titlep)
				#Creating data structure
				dg = myDataGridView()
				#dg.SelectionMode = DataGridViewSelectionMode.CellSelect
				dg.EnableHeadersVisualStyles = False				
				dt = DataTable()
				dl = j.dataList
				for i in range(len(dl[0])):
					if j._hasTitle:
						dt.Columns.Add(remove_accents(dl[0][i].ToString()))
						rngstart = 1
					else:
						dt.Columns.Add("Column " + str(i))
						rngstart = 0						
				for rindex in range(rngstart,len(dl)):
					row = dt.NewRow()
					for i in range(len(dl[rindex])):
						row[i] = dl[rindex][i]
					dt.Rows.Add(row)						
				dg.Tag = j._hasTitle				
				dg.DataSource = dt
				dg.ClipboardCopyMode = DataGridViewClipboardCopyMode.EnableWithAutoHeaderText
				dg.AutoSizeColumnsMode = DataGridViewAutoSizeColumnsMode.AllCells
				dg.Width = formwidth - rightmargin - xlabel
				dg.Location = Point(0,23 * yRatio)
				dg.Height = autoheight
				#Creatin Excel like drag copy functionalities
				dg.CellMouseDown += form.startCell
				dg.CellMouseUp += form.endCell
				#dg.MouseDown += form.startRowDrag
				#dg.MouseUp = 			
				tvp.Controls.Add(dg)			
				y = tvp.Bottom + 15 * yRatio
				#Adding export to excel button
				ex = Button()
				ex.Tag = [j._hasTitle , j._openExcel , j._showinfo , j._fileInfo]
				try:
					expImage = getImageByName("exp.png")[0]
					ex.BackgroundImage = expImage
				except:
					ex.Text = "Export"					
				ex.Width = 60 * xRatio
				ex.Height = 30 * yRatio
				ex.Location = Point(formwidth - 125 * xRatio ,dg.Bottom + 15 * yRatio)					
				tvp.Controls.Add(ex)
				ex.Click += form.exportToExcel
				#Adding filepath export textbox
				filepathtb = TextBox()
				filepathtb.Text = "ExportFileName"
				filepathtb.Location = Point(0 ,dg.Bottom + 20 * yRatio)
				filepathtb.Width = formwidth - xlabel - 125 * xRatio
				tvp.Controls.Add(filepathtb)
				#Adding copy to clipboard button
				cb = Button()
				#Adding panel to form
				formbody.Controls.Add(tvp)
				form.output.append(dg)
				y = tvp.Bottom + 25 * yRatio
				form.topmost()
			elif j.__class__.__name__ == 'uitextnote':
				gb = GroupBox()
				gb.Text = j.title
				gb.Parent = form
				gb.SendToBack()
				gb.BackColor = Color.Transparent
				gb.Location = Point(xlabel, y)
				tn = Label()
				tn.Location = Point(xlabel,18 * yRatio)
				tn.AutoSize = True
				tn.MaximumSize = Size(formwidth - rightmargin - 50 * xRatio,0)
				tn.Text = j.textnote
				tn.BringToFront()
				gb.Controls.Add(tn)
				gb.Size = Size(formwidth  - rightmargin - 25 * xRatio, tn.Bottom-tn.Top+25 * yRatio)  
				y = gb.Bottom + 25 * xRatio
				formbody.Controls.Add(gb)
			elif j.__class__.__name__ == 'uibool':
				yn = CheckBox()
				yn.Width = formwidth - xinput - rightmargin + 10 * xRatio
				yn.Location = Point(xinput,y)
				yn.Text = j.booltext
				g = yn.CreateGraphics()
				sizetext = g.MeasureString(yn.Text,yn.Font, formwidth - xinput - rightmargin -20 * xRatio)
				heighttext = sizetext.Height
				yn.Height = heighttext + 15 * yRatio
				yn.Checked = j.defaultvalue
				formbody.Controls.Add(yn)
				form.output.append(yn)
				y = yn.Bottom + 25 * yRatio
			elif j.__class__.__name__ == 'uiradio':
				yrb = 20 * yRatio
				rbs = []
				rbgroup = mygroupbox()
				if j.inputname != "":
					rbgroup.Width = formwidth - xinput - rightmargin
					rbgroup.Location = Point(xinput,y)
				else:
					rbgroup.Width = formwidth - xlabel - rightmargin
					rbgroup.Location = Point(xlabel,y)					
				rbgroup.Tag = j
				rbcounter = 0
				for key in j.keys():
					if key != 'inputname' and key != 'defaultvalue':
						rb = RadioButton()
						rb.Text = key 
						if j.inputname != "":
							rb.Width = formwidth - xinput - rightmargin - 35 * xRatio
						else:
							rb.Width = formwidth - xlabel - rightmargin - 35 * xRatio
						rb.Location = Point(20 * xRatio,yrb)
						if rbcounter == j.defaultvalue:
							rb.Checked = True
						rbgroup.Controls.Add(rb)
						g = rb.CreateGraphics()
						sizetext = g.MeasureString(key,rb.Font, formwidth - xinput - 90*xRatio)
						heighttext = sizetext.Height
						rb.Height = heighttext + 15 * yRatio
						ybot = rb.Bottom
						yrb += heighttext + 12 * yRatio
						rbcounter += 1
					else:
						pass
				rbgroup.Height = ybot + 20 * yRatio
				[rbgroup.Controls.Add(rb) for rb in rbs]
				formbody.Controls.Add(rbgroup)
				form.output.append(rbgroup)
				y = rbgroup.Bottom + 25 * yRatio
			elif j.__class__.__name__  == 'uifilepath':
				fp = Button()
				if j.inputname != "":
					fp.Width = formwidth - xinput - rightmargin
					fp.Location = Point(xinput,y)
				else:
					fp.Width = formwidth - xlabel - rightmargin		
					fp.Location = Point(xlabel,y)					
				fp.Tag = j.defaultvalue
				if not j.defaultvalue == "FilePath":
					fp.Tag = j.defaultvalue
					fp.MouseHover += form.showtooltip	
				fp.Text = j.buttontext
				fp.Height = 20 * yRatio				
				formbody.Controls.Add(fp)
				fp.Click += form.openfile
				form.output.append(fp)
				y = label.Bottom + 25 * yRatio
			elif j.__class__.__name__ == 'uidirectorypath':
				dp = Button()
				if j.inputname != "":
					dp.Width = formwidth - xinput - rightmargin
					dp.Location = Point(xinput,y)
				else:
					dp.Width = formwidth - xlabel - rightmargin		
					dp.Location = Point(xlabel,y)				
				dp.Tag = j.defaultvalue
				dp.Text = j.buttontext
				if not j.defaultvalue == "DirectoryPath":
					dp.Tag = j.defaultvalue
					dp.MouseHover += form.showtooltip
				dp.Text = j.buttontext	
				dp.Height = 20 * yRatio				
				formbody.Controls.Add(dp)
				dp.Click += form.opendirectory
				form.output.append(dp)
				y = label.Bottom + 25 * yRatio
			elif j.__class__.__name__ == 'uiselectelements':
				se = Button()
				if j.inputname != "":
					se.Width = formwidth - xinput - rightmargin
					se.Location = Point(xinput,y)
				else:
					se.Width = formwidth - xlabel - rightmargin		
					se.Location = Point(xlabel,y)
				se.Text = j.buttontext
				se.Height = 20 * yRatio
				formbody.Controls.Add(se)
				if j.multi == False:
					se.Click += form.pickobjects
				else:
					se.Click  += form.pickobject
				form.output.append(se)
				y = label.Bottom + 25 * yRatio
			elif j.__class__.__name__ == 'uiselectOrderedelements':
				se = Button()
				if j.inputname != "":
					se.Width = formwidth - xinput - rightmargin
					se.Location = Point(xinput,y)
				else:
					se.Width = formwidth - xlabel - rightmargin		
					se.Location = Point(xlabel,y)
				se.Text = j.buttontext
				se.Height = 20 * yRatio				
				formbody.Controls.Add(se)
				se.Click  += form.pickobjectsordered
				form.output.append(se)
				y = label.Bottom + 25 * yRatio
			elif j.__class__.__name__ == 'uiselectlinkedelements':
				se = Button()
				if j.inputname != "":
					se.Width = formwidth - xinput - rightmargin
					se.Location = Point(xinput,y)
				else:
					se.Width = formwidth - xlabel - rightmargin		
					se.Location = Point(xlabel,y)
				se.Text = j.buttontext
				se.Height = 20 * yRatio				
				formbody.Controls.Add(se)
				if j.multi == False:
					se.Click += form.picklinkedobjects
				else:
					se.Click  += form.picklinkedobject
				form.output.append(se)

				y = label.Bottom + 25 * yRatio
			elif j.__class__.__name__ == 'uiselectlinkedelementsofcat':
				sec = Button()
				if j.inputname != "":
					sec.Width = formwidth - xinput - rightmargin
					sec.Location = Point(xinput,y)
				else:
					sec.Width = formwidth - xlabel - rightmargin		
					sec.Location = Point(xlabel,y)
				sec.Text = j.buttontext
				sec.Tag = j.category
				sec.Height = 20 * yRatio
				formbody.Controls.Add(sec)
				if j.multi == False:
					sec.Click += form.picklinkedobjectsofcat
				else:
					sec.Click += form.picklinkedobjectofcat
				form.output.append(sec)
				y = label.Bottom + 25 * yRatio
			elif j.__class__.__name__ == 'uiselectelementsofcat':
				sec = Button()
				if j.inputname != "":
					sec.Width = formwidth - xinput - rightmargin
					sec.Location = Point(xinput,y)
				else:
					sec.Width = formwidth - xlabel - rightmargin		
					sec.Location = Point(xlabel,y)
				sec.Text = j.buttontext
				sec.Tag = j.category
				sec.Height = 20 * yRatio
				formbody.Controls.Add(sec)
				if j.multi == False:
					sec.Click += form.pickobjectsofcat
				else:
					sec.Click += form.pickobjectofcat
				form.output.append(sec)
				y = label.Bottom + 25 * yRatio
			elif j.__class__.__name__ == 'uiselectOrderedelementsofcat':
				sec = Button()
				if j.inputname != "":
					sec.Width = formwidth - xinput - rightmargin
					sec.Location = Point(xinput,y)
				else:
					sec.Width = formwidth - xlabel - rightmargin		
					sec.Location = Point(xlabel,y)
				sec.Text = j.buttontext
				sec.Tag = j.category
				sec.Height = 20 * yRatio
				formbody.Controls.Add(sec)
				sec.Click += form.pickobjectsofcatordered
				form.output.append(sec)
				y = label.Bottom + 25 * yRatio
			elif j.__class__.__name__ == 'uiselectfaces':
				sf = Button()
				if j.inputname != "":
					sf.Width = formwidth - xinput - rightmargin
					sf.Location = Point(xinput,y)
				else:
					sf.Width = formwidth - xlabel - rightmargin		
					sf.Location = Point(xlabel,y)
				sf.Text = j.buttontext
				sf.Height = 20 * yRatio
				formbody.Controls.Add(sf)
				sf.Click += form.pickfaces
				form.output.append(sf)
				y = label.Bottom + 25 * yRatio
			elif j.__class__.__name__ == 'uiselectpointsonface':
				spf = Button()
				if j.inputname != "":
					spf.Width = formwidth - xinput - rightmargin
					spf.Location = Point(xinput,y)
				else:
					spf.Width = formwidth - xlabel - rightmargin		
					spf.Location = Point(xlabel,y)
				spf.Text = j.buttontext
				spf.Height = 20 * yRatio
				formbody.Controls.Add(spf)
				spf.Click += form.pickpointsonface
				form.output.append(spf)
				y = label.Bottom + 25 * yRatio
			elif j.__class__.__name__ == 'uiselectedges':
				sed = Button()
				if j.inputname != "":
					sed.Width = formwidth - xinput - rightmargin
					sed.Location = Point(xinput,y)
				else:
					sed.Width = formwidth - xlabel - rightmargin		
					sed.Location = Point(xlabel,y)
				sed.Text = j.buttontext
				sed.Height = 20 * yRatio
				formbody.Controls.Add(sed)
				sed.Click += form.pickedges
				form.output.append(sed)
				y = label.Bottom + 25 * yRatio
				
			elif j.__class__.__name__ == 'uislider':
				gb = Panel()
				if j.defaultvalue == '':
					defval = j.minimum
				else:
					defval = j.defaultvalue
				sl = mytrackbar(j.minimum,j.step)
				if j.inputname != "":
					gb.Width = formwidth - xinput - rightmargin
					gb.Location = Point(xinput,y)
				else:
					gb.Width = formwidth - xlabel - rightmargin		
					gb.Location = Point(xlabel,y)
				gb.Height = 40 * yRatio
				sl.Minimum = 0
				sl.Maximum = (j.maximum-j.minimum)/j.step
				sl.Value = (defval - j.minimum) / j.step
				sl.TickFrequency = (j.maximum-j.minimum)/j.step/10
				sl.Location = Point(40 * xRatio,0)
				if j.inputname != "":
					sl.Width = formwidth - xinput - rightmargin - 35 * xRatio
				else:
					sl.Width = formwidth - xlabel -rightmargin - 35 * xRatio
				gb.Controls.Add(sl)
				form.output.append(sl)
				displabel = Label()
				displabel.Width = 50 * xRatio
				displabel.Location = Point(0,5 * yRatio)
				displabel.Text = str(defval)
				displabel.Height = 30 * yRatio
				displabel.BringToFront()
				gb.Controls.Add(displabel)	
				formbody.Controls.Add(gb)			
				sl.Scroll += form.scroll
				y = label.Bottom + 25 * yRatio
			elif j.__class__.__name__ == 'uiimage':
				pic = Image.FromFile(j.image)
				im = PictureBox()
				if j.showborder:
					im.BorderStyle = BorderStyle.Fixed3D
				else:
					im.BorderStyle = BorderStyle.None
				ratio = (pic.Height)/(pic.Width)
				h = float(pic.Height)
				w = float(pic.Width)
				ratio = h/w
				image_maxsize = formwidth - xlabel - rightmargin
				im.Size = Size(image_maxsize,image_maxsize*ratio)
				scaledimage = Bitmap(image_maxsize,image_maxsize*ratio)
				gr = Graphics.FromImage(scaledimage)
				gr.DrawImage(pic,0,0,image_maxsize,image_maxsize*ratio)
				im.Image = pic
				im.SizeMode = PictureBoxSizeMode.Zoom
				formbody.Controls.Add(im)
				im.Location = Point(25 * xRatio,y+25*yRatio)
				y = im.Bottom + 25 * yRatio
		
			elif j.__class__.__name__ == 'uicolorpick' and importcolorselection == 0:
				cp = Button()
				if j.inputname != "":
					cp.Width = formwidth - xinput - rightmargin
					cp.Location = Point(xinput,y)
				else:
					cp.Width = formwidth - xlabel - rightmargin		
					cp.Location = Point(xlabel,y)
				cp.Text = j.buttontext
				cp.Height = 30 * yRatio
				formbody.Controls.Add(cp)
				cp.Click += form.colorpicker
				form.output.append(cp)
				y = label.Bottom + 25 * yRatio	
			elif j.__class__.__name__ == 'uicolorpick' and importcolorselection == 1:
				importcolorselection = 2
			elif j.__class__.__name__ == 'uigroup':
				grouppanel = GroupBox()
				grouppanel.Text = j.groupname
				grouppanel.Location = Point(xlabel,y)
				grouppanel.Width = formwidth - 65 * xRatio
				#recursive implementation of the definition to process grouped inputs
				addinput(grouppanel,j.inputgroup,25*yRatio,xinput-25*xRatio,80 * xRatio,90 * xRatio,importcolorselection)
				formbody.Controls.Add(grouppanel)
				y = grouppanel.Bottom + 25 * yRatio
			elif j.__class__.__name__ == 'uiconditional':
				grouppanelcond = GroupBox()
				grouppanelcond.Location = Point(xlabel,y)
				grouppanelcond.Width = formwidth - 65 * xRatio	
				form.output.append(grouppanelcond)				
				#recursive implementation of the definition to process conditional groups of inputs
				panlist = []
				rblist = []
				yp = 25 * yRatio
				xrb = 25 * xRatio
				for i,d in zip(j._Conditions,j._GroupedInputs):	
					rb = RadioButton()
					rb.CheckedChanged += form.ActivateOption
					rb.Text = i
					rb.Location	= Point(xrb,10*yRatio)
					rb.Width = 95 * xRatio
					rblist.append(rb)					
					grouppanelcond.Controls.Add(rb)				
					condition_pannel = Panel()
					condition_pannel.Name = i
					condition_pannel.Top = yp
					condition_pannel.Width = formwidth - 65 * xRatio
					condition_pannel.BackColor = Color.Transparent
					condition_pannel.BringToFront()					
					addinput(condition_pannel,d,25*yRatio,xinput-25*xRatio,80*xRatio,90*xRatio,importcolorselection)
					panlist.append(condition_pannel)
					yp = condition_pannel.Bottom - 25*yRatio
					xrb += 100 * xRatio
				for pan in panlist:
					grouppanelcond.Controls.Add(pan)
				for e,pan in enumerate(panlist):
					if e != j._defaultOptionIndex:
						pan.Enabled = False
					else:
						continue
				rblist[j._defaultOptionIndex].Checked = True
				grouppanelcond.Height = sum([p.Height for p in panlist]) - (len(panlist)-2)*25 * yRatio
				grouppanelcond.BackColor = Color.Transparent				
				formbody.Controls.Add(grouppanelcond)
				form.output.append([grouppanelcond.Tag])				
				y = grouppanelcond.Bottom + 25*yRatio
			formbody.Height = y


	# process input lists 
	addinput(body,inputtypes,0,xinput,40 * xRatio ,120 * xRatio,importcolorselection)
	
	#add the formbody panel to the form
	form.Controls.Add(body)		
	

	if IN[6] != None:
		if IN[8] > 400 * yRatio:
			formy += 50 * yRatio
			xinput = 270 * yRatio
		else:
			formy = logo.Bottom + 20 * yRatio
	else:
		formy += 50 * yRatio



	#Adding validation button
	
	button = Button()
	button.Text = IN[1]
	button.Width = formwidth - xinput - 40 * xRatio
	button.Height = 20 * yRatio
	button.Location = Point (xinput,formy)
	button.Click += form.setclose
	form.Controls.Add(button)
	form.MaximizeBox = False
	form.MinimizeBox = False
	form.FormBorderStyle = FormBorderStyle.FixedSingle
	
	#Adding Cancel button
	if IN[6] != None:
		cancelbutton = Button()
		cancelbutton.Text = IN[6]
		cancelbutton.Width = 120 * xRatio
		cancelbutton.Height = 20 * xRatio
		cancelbutton.Name = "Cancel"
		cancelbutton.Location = Point (xinput -120 * xRatio ,formy)
		cancelbutton.Click += form.setclose
		form.Controls.Add(cancelbutton)
		form.CancelButton = cancelbutton
	
	#Adding link to help
	
	if IN[5] != None :
		helplink = LinkLabel()
		helplink.Text = "Help"
		helplink.Tag = IN[5]
		helplink.Click += form.openurl
		helplink.Location = Point(formwidth - 65 * xRatio ,formy+30 * yRatio)
		form.Controls.Add(helplink)
	else:
		pass	
			
	form.ShowIcon = True
	form.Width = formwidth
	form.Height = formy + 120 * yRatio
	formfooterheight = form.Height - formheaderheight
	
	# Make formbody scrollable
	
	# if the form is longer than its maximum height, do the following:
	# modify the form height
	# make the formbody panel scrollable
	if form.Height + body.Height > IN[7] * yRatio and IN[7] * yRatio > 0:
		formbody_calculatedheight = IN[7] * yRatio - form.Height
		# make sure the formbody is at least 100 px high
		if formbody_calculatedheight < 100 * yRatio: formbody_calculatedheight = 100 * yRatio
		body.Height = formbody_calculatedheight
		form.Height = form.Height + formbody_calculatedheight
		# this (and apparently only this) will implement a vertical AutoScroll *only*
		# http://stackoverflow.com/a/28583501
		body.HorizontalScroll.Maximum = 0
		body.AutoScroll = False
		body.VerticalScroll.Visible = False
		body.AutoScroll = True
		body.BorderStyle = BorderStyle.Fixed3D
	else:
		form.Height = form.Height + body.Height
	# Move footer elements
	logo.Location = Point(logo.Location.X, logo.Location.Y + body.Height)
	button.Location = Point(button.Location.X, button.Location.Y + body.Height)
	if IN[6] != None: cancelbutton.Location = Point(cancelbutton.Location.X, cancelbutton.Location.Y + body.Height)
	if IN[5] != None: helplink.Location = Point(helplink.Location.X, helplink.Location.Y + body.Height)

	#Positionning the form at top left of current view
	uiviews = uidoc.GetOpenUIViews()
	if doc.ActiveView.IsValidType(doc.ActiveView.GetTypeId()):
		activeviewid = doc.ActiveView.Id
		activeUIView = [v for v in uiviews if v.ViewId == activeviewid][0]
	else:
		activeUIView = uiviews[0]
	rect = activeUIView.GetWindowRectangle()
	form.StartPosition = FormStartPosition.Manual
	form.Location = Point(rect.Left-7 * xRatio,rect.Top)
	
		
	if IN[2]:
		if importcolorselection != 2:
			Application.Run(form)
			result = form.values
			OUT = result,True, form.cancelled 
		else:
			OUT = ['ColorSelection input is only available With Revit 2017'] , False, False
	else :
		OUT = ['Set toggle to true!'] , False, False
except:
	import traceback
	OUT = traceback.format_exc() , "error", "error"
# ----------------------------------------
code_block_11 = CodeBlock(OUT=python_script_2) { OUT[0]; OUT[1]; OUT[2]; }

# group: ACTION - DATA Get Excel File Content
# note: BACKEND
file_from_path = FileObject(path=code_block_11.out0)
code_block_12 = CodeBlock { "WORKSETS SETUP"; }
code_block_13 = CodeBlock { true; }
code_block_14 = CodeBlock { true; }
importExcel = Data.ImportExcel(file=file_from_path, sheetName=code_block_12, readAsStrings=code_block_13, showExcel=code_block_14)
code_block_15 = CodeBlock { 0; }
removeItemAtIndex = List.RemoveItemAtIndex(list=importExcel@L2, indices=code_block_15)
code_block_16 = CodeBlock { false; }
clean = List.Clean(list=removeItemAtIndex, preserveIndices=code_block_16)
code_block_17 = CodeBlock(x=clean) { x[0]; x[1]; x[2]; x[3]; x[4]; }

# group: ACTION - DATA Get a list of revit links and create a list of worksets names with ZL_ as prefix
empty = List.Empty()
python_script_3 = Python(IN[0]=empty)
# ---------- python_script_3.python (43 lines) ----------
#Copyright(c) 2015, Konrad K Sobon
# @arch_laboratory, http://archi-lab.net

import clr
clr.AddReference('ProtoGeometry')
from Autodesk.DesignScript.Geometry import *

# Import DocumentManager and TransactionManager
clr.AddReference("RevitServices")
import RevitServices
from RevitServices.Persistence import DocumentManager
from RevitServices.Transactions import TransactionManager

from System.Collections.Generic import *

# Import RevitAPI
clr.AddReference("RevitAPI")
import Autodesk
from Autodesk.Revit.DB import *
from Autodesk.Revit.DB.Analysis import *

doc = DocumentManager.Instance.CurrentDBDocument
uiapp = DocumentManager.Instance.CurrentUIApplication
app = uiapp.Application

# Import ToDSType(bool) extension method
clr.AddReference("RevitNodes")
import Revit
clr.ImportExtensions(Revit.Elements)

#The inputs to this node will be stored as a list in the IN variable.
dataEnteringNode = IN

collector = Autodesk.Revit.DB.FilteredElementCollector(doc)
linkInstances = collector.OfClass(Autodesk.Revit.DB.RevitLinkInstance)

linkDoc, linkName, linkInstId = [], [], []
for i in linkInstances:
	linkDoc.append(i.GetLinkDocument())
	linkName.append(i.Name)
	linkInstId.append(i.Id)

OUT = linkName
# ----------------------------------------
string = StringInput(":")
split = String.Split(str=python_script_3, separator0=string)
firstItem = List.FirstItem(list=split@L2)
uniqueItems = List.UniqueItems(list=firstItem)
string_2 = StringInput(".")
split_2 = String.Split(str=uniqueItems, separator0=string_2)
firstItem_2 = List.FirstItem(list=split_2@L2)
toUpper = String.ToUpper(str=firstItem_2)
code_block_18 = CodeBlock(a=toUpper) { "ZL_"+a; }

# group: ACTION DATA Assemble strings of worksets names
code_block_19 = CodeBlock { 0; }
insert = String.Insert(str=code_block_17.out4, index=code_block_19, toInsert=code_block_17.out0, lacing=Longest)
list_create = List.Create(item0=insert, item1=code_block_17.out3, item2=code_block_18)
flatten = List.Flatten(list=list_create)
code_block_20 = CodeBlock { false; }
clean_2 = List.Clean(list=flatten, preserveIndices=code_block_20)

# group: RHYTHM workset create
create_workset = Python(IN[0]=clean_2)
# ---------- create_workset.python (42 lines) ----------
#Rhythm
#sixtysecondrevit.blogspot.com
import clr
clr.AddReference('ProtoGeometry')
from Autodesk.DesignScript.Geometry import *
# Import ToDSType(bool) extension method
clr.AddReference("RevitNodes")
import Revit
clr.ImportExtensions(Revit.Elements)
# Import geometry conversion extension methods
clr.ImportExtensions(Revit.GeometryConversion)
# Import DocumentManager and TransactionManager
clr.AddReference("RevitServices")
import RevitServices
from RevitServices.Persistence import DocumentManager
from RevitServices.Transactions import TransactionManager
from System.Collections.Generic import *
# Import RevitAPI
clr.AddReference("RevitAPI")
import Autodesk
from Autodesk.Revit.DB import *

doc = DocumentManager.Instance.CurrentDBDocument
uiapp = DocumentManager.Instance.CurrentUIApplication
app = uiapp.Application
uidoc=DocumentManager.Instance.CurrentUIApplication.ActiveUIDocument

worksetnames = IN[0]
mDoc = DocumentManager.Instance.CurrentDBDocument
newWorksets = list()

# Start Transaction
TransactionManager.Instance.EnsureInTransaction(doc)

for name in worksetnames:
	Workset.Create(mDoc,name)
	newWorksets.append(name)

# End Transaction
TransactionManager.Instance.TransactionTaskDone()

OUT = newWorksets
# ----------------------------------------

# group: ACTION - DATA Get Revit Language
python_script_get_revit_language = Python()  # unwired: IN[0]
# ---------- python_script_get_revit_language.python (7 lines) ----------
import clr
clr.AddReference('RevitServices')
from RevitServices.Persistence import DocumentManager

doc = DocumentManager.Instance.CurrentDBDocument

OUT = doc.Application.Language=="French"
# ----------------------------------------

# group: ACTION - DATA get and filter system worksets (by name)
code_block_21 = CodeBlock { true; }
get_all_worksets = Python(IN[0]=code_block_21)
# ---------- get_all_worksets.python (31 lines) ----------
import clr
clr.AddReference('ProtoGeometry')
from Autodesk.DesignScript.Geometry import *

# Import DocumentManager and TransactionManager
clr.AddReference("RevitServices")
import RevitServices
from RevitServices.Persistence import DocumentManager
from RevitServices.Transactions import TransactionManager

# Import RevitAPI
clr.AddReference("RevitAPI")
import Autodesk
from Autodesk.Revit.DB import *

#The inputs to this node will be stored as a list in the IN variables.
toggleForRefresh = IN[0] # HACK: toggling the value of this boolean will cause Dynamo to re-execute this python script.


doc = DocumentManager.Instance.CurrentDBDocument
collector = FilteredWorksetCollector(doc)
worksets = collector.OfKind(WorksetKind.UserWorkset).ToWorksets()

# Convert Revit Workset elements to Dynamo Workset objects ('True' means "Revit-owned" as opposed to Dynamo-created elements)

worksetInt = []

for i in worksets:
	worksetInt.append(i.Id.IntegerValue)

OUT = worksetInt, list(workset.Name for workset in worksets)
# ----------------------------------------
code_block_22 = CodeBlock(x=get_all_worksets) { x[0]; x[1]; }
string_3 = StringInput("partagés")
string_4 = StringInput("Shared")
if_ = If(test=python_script_get_revit_language, true=string_3, false=string_4)
contains = String.Contains(str=code_block_22.out1, searchFor=if_)
filterByBoolMask = List.FilterByBoolMask(list=code_block_22.out0, mask=contains)
string_5 = StringInput("Sous-projet 1")
string_6 = StringInput("Workset1")
if_2 = If(test=python_script_get_revit_language, true=string_5, false=string_6)
contains_2 = String.Contains(str=code_block_22.out1, searchFor=if_2)
filterByBoolMask_2 = List.FilterByBoolMask(list=code_block_22.out0, mask=contains_2)
create = List.Create(item0=filterByBoolMask.in, item1=filterByBoolMask_2.in)

flatten_2 = List.Flatten(list=create)
create_2 = List.Create(item0=code_block_17.out1, item1=code_block_17.out2)
flatten_3 = List.Flatten(list=create_2)

# group: ACTION - DATA Create aworksets from a list Change name of system worksets
python_script_4 = Python(IN[0]=flatten_2, IN[1]=flatten_3)
# ---------- python_script_4.python (32 lines) ----------
import clr
clr.AddReference('RevitAPI')
from Autodesk.Revit.DB import *

clr.AddReference('RevitNodes')
import Revit
clr.ImportExtensions(Revit.GeometryConversion)
clr.ImportExtensions(Revit.Elements)

clr.AddReference('RevitServices')
import RevitServices
from RevitServices.Persistence import DocumentManager
from RevitServices.Transactions import TransactionManager

doc = DocumentManager.Instance.CurrentDBDocument

#Converting input from Dynamo to Revit

workset = UnwrapElement(IN[0])
names = IN[1]


#rename workset in a transaction
TransactionManager.Instance.EnsureInTransaction(doc)

# for each workset in the inputted list of worksets
for workset, name in zip(workset, names):
	WorksetTable.RenameWorkset(doc, WorksetId(workset), name);

TransactionManager.Instance.TransactionTaskDone()

OUT = names
# ----------------------------------------

# group: MONITORING Compose report
code_block_23 = CodeBlock()
# ---------- code_block_23.designscript (2 lines) ----------
["Worksets created",
""];
# ----------------------------------------
code_block_24 = CodeBlock { ", "; }
join = String.Join(separator=code_block_24, string0=create_workset)
code_block_25 = CodeBlock()
# ---------- code_block_25.designscript (2 lines) ----------
["","System worksets modified",
""];
# ----------------------------------------
code_block_26 = CodeBlock { ", "; }
join_2 = String.Join(separator=code_block_26, string0=python_script_4)

# group: MONITORING Count how many were processed
python_script_5 = Python(IN[0]=code_block_23, IN[1]=join, IN[2]=code_block_25, IN[3]=join_2)
# ---------- python_script_5.python (16 lines) ----------
# BIM One Inc. - Jean-Marc Couffin - 2019

import clr
clr.AddReference('RevitAPIUI')
from Autodesk.Revit.UI import TaskDialog


Title = "Worksets"

a = str('\n'.join(IN[0]))
b = str('\n'.join(IN[1]))
c = str('\n'.join(IN[2]))
d = str('\n'.join(IN[3]))


TaskDialog.Show( Title, a+b+'\n'+c+d  )
# ----------------------------------------
